# Grasshopper definition UI_9130_sun hour analysis_vLandscape.gh (Grasshopper 1.0.7)
# plug-ins: Telepathy, ProvingGround.Conduit, FalseStartToggle, Human, Pufferfish, EleFront, treesloth01, Parakeet, eleFront, Sasquatch, MetaHopper, Human UI, Wombat

file_path = FilePath("H:\Tools & Libraries\34 - Rhino\07_GH_SCRIPTS_KCAP_TOOLS\9000_ANALYSIS\9100_SUN\EPWs\")

# ---- group: COLOR MAP
_1 = ColourSwatch(SwatchColor=RGBA(255, 234, 0, 100))
_5 = ColourSwatch(SwatchColor=RGBA(0, 212, 255, 100))
_4 = ColourSwatch(SwatchColor=RGBA(255, 0, 0, 100))
_4_2 = ColourSwatch(SwatchColor=RGB(255, 0, 0))
_3 = ColourSwatch(SwatchColor=RGBA(128, 128, 128, 100))
# TEMPLATE DATA
# Size 50: description of group
# more visual significance desired
# Size 75: Important but
# bigger size just seems to big
# Size 100: Important or
# Major Step/Section/Subscript, etc
_0 = ColourSwatch(SwatchColor=RGBA(255, 128, 0, 100))
_2 = ColourSwatch(SwatchColor=RGBA(170, 0, 255, 100))
_2_2 = ColourSwatch(SwatchColor=RGBA(4, 255, 0, 100))
_3_2 = ColourSwatch(SwatchColor=RGBA(51, 51, 51, 100))
_5_2 = ColourSwatch(SwatchColor=RGBA(0, 106, 255, 100))
panel = Panel("""GEO
MATH
LOGIC
DATA
INPUT
EXCEL
WIP
INFO
ENGINE
VIZ
OUT
CUT""")

_5_3 = ColourSwatch(SwatchColor=RGBA(212, 255, 0, 100))
# KCAP
_5_4 = ColourSwatch(SwatchColor=RGB(0, 0, 0))
entwine = Entwine(
    Branch00=_0,
    Branch01=_1,
    Branch02=_2,
    Branch03=_5,
    Branch04=_4,
    Branch05=_2_2,
    Branch06=_4_2,
    Branch07=_3,
    Branch08=_3_2,
    Branch09=_5_3,
    Branch010=_5_2,
    Branch011=_5_4,
    FlattenInputs=True)  # -> flatten(Result)
default_color = ColourSwatch(SwatchColor=RGBA(255, 255, 255, 100))
trigger = Timer(Interval=1000, TimerInterval=1000, Target=[ghpython_script, time])
ghpython_script = GhPythonScript(group_names=panel, colors=entwine, default_color=default_color)  # inputs group_names: list, colors: list of Color
# ---------- ghpython_script: Python ----------
import Grasshopper

doc = ghenv.Component.Attributes.Owner.OnPingDocument()
for i in doc.Objects:
    if str(type(i)) == "<type 'GH_Group'>":
        name_of_current_group = i.NickName.ToString()
        if name_of_current_group in group_names:
            index = group_names.index(name_of_current_group)
            color = colors[index]
            i.Colour = color
        else:
            i.Colour = default_color
# ---------- end ghpython_script ----------

# ----
# Components NOT to Identify: Relay
# False Start Toggle
# Volume
# Project
# Point
# Data
# Subtraction
# Multiplication
# Dispatch
# Advanced Custom Preview
# Colour Swatch
# Custom Preview
button = Button()
o_getcomps2 = OTools_GetComponents2(x=button)  # inputs x: Boolean; plug-in component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

# ---- group: INPUT / Run Analysis + Color Map
run_it = FalseStartToggle(False)

# ----
# Steps to Follow --CONDUIT plugin:
# 
# 0.
# First read the "Read Only Guide" to understand why checking conduit settings is important.
# 
# 
# 1.
# Required -- Set to “True” if you want to show the Legend within the Rhino ViewPort
# 
# 
# 2.
# Optional – Resize the white box framing and change typeface.
# 
# 
# 3.
# Required – Set this slider to resize all fonts to match your ViewPort Resolution.
# 
# 
# 4.
# Optional – Resize Pie Chart captions if needed
# 
# 
# 5.
# Required – Change Project information to be displayed in the data box.
# 
# 
# 6.
# Optional -- Set toggle to “True” or “False” in case you want to show KCAP’s logo on the right down corner.
º_error = Slider(10, range=0..10)

# ---- group: Developer
panel_2 = Panel("a.fuentes@kcap.eu")
# 0. Set input parameters
panel_3 = Panel("2021.06")

# ---- group: INPUT
# 1.D
hours_breaks = Panel("""0
1
2
4
6
10
30""")
in_num_sungroups = RemoteSender(hours_breaks)

# 1. Set Legend
# Before starting, make sure you set the page layout, representing the outline of the page you are printing.
# 
# 1.
# Required - Project specific information
# 
# 
# 2.
# Required – Analysis type, Option number / General Situation and the time (date or annual).
# 
# 
# 3.
# Optional - Parameters for the legend appearance.
# 0. Layout Size
number_slider = Slider(420, range=0..1000)
rectangle = Rectangle(Plane=PlaneXY(0, 0, 0), XSize=number_slider, YSize=Slider(297, range=0..1000), Radius=0)  # -> Rectangle, Length
layout_page = RemoteSender(rectangle.Rectangle)

# Steps to Follow -- ANALYSIS:
# 
# 0.
# ATTENTION – Set to True if change of location is needed.
# 
# A.
# Optional -- If true, you will be brought to a world map where to copy paste a link.
# 
# B.
# Optional – Paste new location link in the left panel.
# 
# 
# 1.
# Required – Check defined date and hour range for the sun analysis.
# 
# 1.A
# Optional – Set the amount of times the hour is divided (f.e. 1 = every hour: 2 = every 30 min.)
# 
# 1.B
# Optional – Double click to ignore Daylight Savings Time.
# 
# 
# 2.Choose if you want to indicate the layer for your geometry or assign it manualy
# 
# 
# 2.A
# Required -- Add your massing geometry here  OR   type the name of layer where it is. Note: It should work with Solids. It won't work with complex or broken geometries.
# 
#  2.B
# Required – Introduce Variant / project phase to display in the legend band.
# 
# 
# 4.A
# Required – Set context Geometry  OR type the name of the layer where it is
# 
# 
# 5.
# Required –Check pixel Size for the analysis. Note: the loger the numer, the heavier the computation time.
# 
# 
# 6
# Required -- Set critical amount of hrs of sun(specified Local Regulations requirements, f.e. asses area with more than 2 hours of shadowing a day).
# 
# 7
# Required – Set toggle to True to run the analysis.
# 
# 
# 8
# Required – Choose whether to viz the whole set of geometry, just the proposal’s façade, all horizontal surfaces or limited horizontal surfaces.
# Note: if set geometry not hidden, use slider to lift up the mesh in order to avoid overlapping.
# 
# 9.A
# Optional – Bake chosen coloured mesh.
# 
# 9.B
# Optional – Bake points that receive =/< than 2Hrs of sun in the defined period.
# 1.C
critical_am_of_hours = Slider(1, range=0..10)
in_num_critic = RemoteSender(critical_am_of_hours)

# 2. Analysis info
panel_4 = Panel("Hours of sun // Percentage:")
legend_title = RemoteSender(panel_4)

# 3. Legend appearance
horizontalratio = Slider(0.25, range=0..1)
panel_5 = Panel("""GT America LC Ext Rg
GT America LC Md
GT America LC Rg""")
panel_6 = Panel("""GT_America_Bold
GT_America_Rg""")
list_item = ListItem(List=panel_6, Index=0, Wrap=True)  # -> Item, Item1
list_item_2 = ListItem(List=panel_5, Index=0, Wrap=True)  # -> Item, Item1, Item2
txt_americabold = RemoteSender(list_item.Item)
horizontal_ratio = RemoteSender(horizontalratio)
txt_americarg = RemoteSender(list_item.Item1)
sty_americabold = RemoteSender(list_item_2.Item)
sty_americarg = RemoteSender(list_item_2.Item2)

# 8
# Bake mesh
button_2 = Button()  # disabled
bake_mesh = RemoteSender()  # disabled

# 3
number_slider_2 = Slider(134.9, range=50..300)
type_size = Slider(126.44, range=0..200)

# Basic Layout Preset
# 2
white_band_offset_size = Slider(30, range=0..50)
in_num_legsteps = RemoteSender(Slider(15, range=0..15))

# 4
relative_label_size = Slider(0.081, range=0..0.1)

# 5
# Data Box
project_name = Panel("1844 Lauwerecht")
location_city_country_code = Panel("Utrecht [NL]")

# ---- group: INPUT / Set TRUE to see the KCAP UI
button_3 = Button()
# 1
boolean_toggle = BooleanToggle(True)

# ---- group: INPUT
# 7
in_bool_run = RemoteSender(run_it)

# ----
º_error_2 = RemoteSender(º_error)
merge = Merge(Data1=project_name, Data2=location_city_country_code)
cond_whiteband = RemoteSender(white_band_offset_size)
cond_boldheight = RemoteSender(type_size)
cond_pieheight = RemoteSender(relative_label_size)
cond_txtheight = RemoteSender(number_slider_2)

# ---- group: DATA
# PlugIns Used: FalseStartToggle
# treesloth01
# ProvingGround.Conduit 2018.11.19.0
# eleFront 5.0.5-beta
# Parakeet 0.8.3
# Telepathy
# EleFront 0.1.0.0
# MetaHopper 1.2.4
# Wombat 1.1.0.0
# Human 1.1.0
# Pufferfish 3.0.0.0
# Sasquatch
# Human UI 0.8.8
panel_7 = Panel("now")
time = Time(panel_7)
panel_8 = Panel(time)
data_dam = DataDam(DataDataA=time, BufferDelay=10000000, BufferMode=0)
# Steps to Follow:
# 
# 0. This component is required to tell LadyBug to  run. Nothing for the User to do here.
# 
# 1. If needed, get your Weather Data using LadyBug Tools
# 
# 2. Define your Analsis Period
# 
# 3. Set Your Geometry
# 
# 4. Set Context Geometry
# 
# 5..7. Refine, Introduce Norm Restricions & Run the Analaysis
# 
# 8. Select View Type and ViZ settings
# 
# 9. Bake Your Results or run a Screen Capture
panel_9 = Panel(",(")
text_split = TextSplit(Text=data_dam, Separators=panel_9)
list_item_3 = ListItem(List=text_split, Index=0, Wrap=True)  # -> Item, Item1
# Original Script found here, prepared by Mostapha Roudsari of Ladybug.
# 
# http://hydrashare.github.io/hydra/viewer?owner=mostaphaRoudsari&fork=hydra_1&id=Central_Park_Shadow_Study&slide=0&scale=1&offset=0,0
# 
# This script shows how to use Ladybug's sunpath and sunlightHours analysis to identify which part of a building needs to be removed so the analysis geometry can see more than X hours of sunlight.
# 
# User inputs include:
# -location
# -analysis date
# -analysis period (time of day)
# -hours to count
# -visualization color gradient
# 
# 
# 
# #Grasshopper #Ladybug #Shadow #MinimumSunlight #OpenData
text_trim = TextTrim(Text=list_item_3.Item1, Start=True, End=True)
txt_date = RemoteSender(text_trim)

# ----
txt_projectplaceholder = RemoteSender(merge)

# ---- group: INPUT
# Operate
panel_10 = Panel("Run Analysis")
create_toggle = CreateToggle(Default=False, Label=panel_10)

# ---- group: CUT
data = Data()
data_2 = Data()

# ---- group: INPUT
create_text_box = CreateTextBox(Label="Version/Option", DefaultText="Option01", UpdateButton=Toggle(False), showLabel=True)

# ---- group: CUT
# 2. Set HumanUi
data_3 = Data()
data_4 = Data()

data_5 = Data()
data_6 = Data()

# ----
panel_11 = Panel("""Netherlands
Switzerland
Belgium
Germany North
Germany South
France North
France South
Luxemburg
Other""")
panel_12 = Panel("https://climate..........................TMYx.2007-2021.zip")
# Location
# Climate
# Set-up
boolean_toggle_2 = BooleanToggle(False)
panel_13 = Panel("""Annual analysis
Winter Week
Spring Week
Summer Week
Autumn  Week""")
panel_14 = Panel("""1
5
10
15
30
60""")

# ---- group: CUT
# Geometry
# Set Up
data_7 = Data()
data_8 = Data()

data_9 = Data()
data_10 = Data()

# ----
# Headers
panel_15 = Panel("Script title:")
panel_16 = Panel("H:\Tools & Libraries\000 - Logo\Logo-Black\KCAP_Logo-Black.png")

# ---- group: INPUT
create_toggle_2 = CreateToggle(Default=False, Label="Preview")

create_label = CreateLabel(LabelText="Show in legend:", LabelSize=12, Justification=0)

# ----
concatenate = Concatenate(FragmentA=panel_14, FragmentB=" min")
launch_window = LaunchWindow(Show=Toggle(True), Name="LANDSCAPE SUN-HOUR ANALYSIS", Width=370, Height=400, ChildStatus=2, EnableHorizScroll=False)
create_text_box_2 = CreateTextBox(Label=panel_15, DefaultText="Planting Sun-Steps", UpdateButton=True, showLabel=True)
create_text_box_3 = CreateTextBox(Label="Resolution (m)", DefaultText="3.0", UpdateButton=True, showLabel=True)
create_rhino_pick_button = CreateRhinoPickButton(
    ButtonName="Analysis Geometry",
    Prompt="Please select geometry...",
    AllowMultiple=True,
    AllowNone=Toggle(False),
    Type=0,
    ButtonStyle=0)
create_rhino_pick_button_2 = CreateRhinoPickButton(
    ButtonName="Shading Geometry",
    Prompt="Please select geometry...",
    AllowMultiple=True,
    AllowNone=True,
    Type=0,
    ButtonStyle=0)
create_image = CreateImage(ImageSource=panel_16, ImageWidth=Slider(100, range=0..100))
create_button = CreateButton(ButtonName="Bake Mesh", ButtonStyle=0)
create_label_2 = CreateLabel(LabelText="(type name, resolution and click buttons on right)", LabelSize=12, Justification=1)
create_button_2 = CreateButton(ButtonName="Bake Legend", ButtonStyle=0)
create_pulldown_menu = CreatePulldownMenu(Label="Pick Location", ListItems=panel_11, showLabel=True)
create_pulldown_menu_2 = CreatePulldownMenu(Label="Pick Period:", ListItems=panel_13, showLabel=True)
create_pulldown_menu_3 = CreatePulldownMenu(Label="Timestep:", ListItems=concatenate, SelectedIndex=Slider(1, range=0..5), showLabel=True)
create_text_box_4 = CreateTextBox(Label="Paste .zip link:", DefaultText=panel_12, UpdateButton=boolean_toggle_2, showLabel=True)

# ---- group: CUT
data_11 = Data()
data_12 = Data()

# ---- group: VIZ
accent_colors = ValueList({"Amber", "Blue", "Brown", "Cobalt", "Crimson", "Cyan", "Emerald", "Green", "Indigo", "Lime", "Magenta", "Mauve", "Olive", "Orange", "Pink", "Purple", "Red", "Sienna", "Steel", "Taupe", "Teal", "Violet", "Yellow"}, selected="Steel")
winprops = SetWindowProperties(Window=launch_window, AccentColor=accent_colors, ShowTitleBar=True, ScaleFactor=1)

# ---- group: CUT
data_13 = Data()
data_14 = Data()

# ----
# 1. Import environment parameter
all_components_used = Panel("""DATE- 2023.04.18 TIME- 16:51h
Last saved by - A.Fuentes
Total Components - 1273
eleFront Beta:
...04 Annotations:
......Define Hatch - 2
Human:
...Reference:
......Sort Objects By Type - 1
...Display:
......Custom Preview Lineweights - 2
...Misc:
......Directory Contents - 2
Surface:
...Primitive:
......Bounding Box - 2
...Freeform:
......Extrude - 2
......Boundary Surfaces - 2
...Analysis:
......Deconstruct Brep - 4
......Dimensions - 3
......Area - 15
MetaHopper:
...Object Retrieval:
......Get Objects of Same Type - 1
...Utility:
......Set Object Value - 1
Display:
...Preview:
......Create Material - 1
OTools:
...3 | Debugging:
......OTools_GetComponents2 - 1
Parakeet:
...Util:
......Interpolate Color - 1
Maths:
...Script:
......Evaluate - 2
......GhPython Script - 1
...Time:
......Construct Time - 1
...Domain:
......Includes - 4
......Construct Domain - 3
......Consecutive Domains - 2
......Deconstruct Domain - 2
...Trig:
......Degrees - 1
...Operators:
......Smaller Than - 1
......Mass Addition - 5
......Negative - 11
......Subtraction - 16
......Larger Than - 2
......Absolute - 2
......Multiplication - 6
......Division - 16
Ladybug:
...2 :: Visualize Data:
......LB SunPath - 1
...3 :: Analyze Geometry:
......LB Direct Sun Hours - 1
...1 :: Analyze Data:
......LB Analysis Period - 2
......LB HOY to DateTime - 2
...0 :: Import:
......LB Import STAT - 1
......LB Import Location - 1
......LB Download Weather - 1
...4 :: Extra:
......LB Legend Parameters - 1
Mesh:
...Util:
......Mesh Join - 2
......Cull Faces - 4
......Mesh Brep - 1
...Primitive:
......Construct Mesh - 5
...Analysis:
......Mesh Edges - 2
......Deconstruct Mesh - 5
Human UI:
...UI Main:
......Adjust Element Positioning - 6
......Add Elements - 1
......Value Listener - 14
......Launch Window - 1
......Set Window Properties - 1
...UI Containers:
......Create Expander - 3
......Create Stack - 2
...UI Elements:
......Create Button - 2
......Create Pulldown Menu - 3
......Create Rhino Pick Button - 2
......Create Text Block - 1
......Create Label - 2
......Create Image - 1
......Create Text Box - 5
......Create Toggle - 2
Elefront:
...06 Bake:
......Bake Objects - 12
...03 Attributes:
......Define Object Attributes - 11
...04 Annotations:
......Define Hatch - 1
......Define Text Object (R6) - 7
......Define Hatch (R6) - 1
Wombat:
...Files / Interop:
......Launch URL - 1
Sasquatch:
...Curve:
......Connect Curve Ends - 1
Sets:
...List:
......Longest List - 1
......Replace Nulls - 2
......Sort List - 2
......Shift List - 1
......List Length - 17
......Null Item - 1
......Replace Items - 1
......Reverse List - 1
......Dispatch - 3
......List Item - 50
...Sequence:
......Series - 3
......Repeat Data - 7
......Cull Index - 6
......Cull Pattern - 9
......Range - 3
...Tree:
......Merge - 23
......Tree Branch - 10
......Shift Paths - 3
......Stack Trees - 11
......Stream Filter - 2
......Tree Statistics - 8
......Graft Tree - 2
......Entwine - 8
...Text:
......Concatenate - 34
......Text Trim - 1
......Text Join - 2
......Text Split - 5
......Sort Text - 2
...Sets:
......Member Index - 1
......Create Set - 2
Params:
...Input:
......Value List - 2
......Panel - 154
......False Start Toggle - 1
......Button - 3
......Colour Swatch - 29
......Boolean Toggle - 19
......Number Slider - 89
...Primitive:
......Time - 1
......File Path - 2
......Boolean - 2
......Colour - 1
......Data - 33
......Integer - 8
......Number - 4
...Telepathy:
......Remote Sender - 80
......Remote Receiver - 181
...Util:
......Scribble - 82
......Relay - 21
......Timer - 1
......Data Dam - 2
...Geometry:
......Geometry - 6
......Mesh - 7
......Curve - 8
Pufferfish:
...List:
......List Indices - 1
...Mesh:
......Rebuild Mesh - 1
...Curve:
......Bounding Rectangle - 4
...Transform:
......Move To Point - 2
...Number:
......X Minus One - 2
......Round To Decimal Place - 1
Vector:
...Vector:
......Unit Y - 2
......Unit Z - 1
......Unit X - 2
......Angle - 1
...Point:
......Sort Points - 3
Curve:
...Util:
......Offset Curve - 6
......Join Curves - 3
......Explode - 8
...Primitive:
......Circle - 1
......Rectangle - 1
...Division:
......Shatter - 3
...Analysis:
......Length - 2
......Point On Curve - 1
......Curve Middle - 2
Proving Ground:
...HUD:
......Conduit Font - 6
......Draw a Mesh - 4
......Conduit Pie Style - 1
......Horizontal Tiles - 2
......Irregular Grid Tiles - 11
......Get viewport boundary dimensions - 1
......Heads Up Display (HUD) - 1
......Draw Text - 6
......Draw Pie Chart - 1
......Conduit ColorPalette - 1
......Vertical Tiles - 2
Transform:
...Euclidean:
......Move - 4
...Affine:
......Scale NU - 2
......Scale - 2
......Project - 1""")

# ---- group: MATH
in_num_sungroups_2 = RemoteReceiver(in_num_sungroups)
shift_list = ShiftList(List=in_num_sungroups_2, Shift=1, Wrap=False)
subtraction = Subtraction(A=shift_list, B=in_num_sungroups_2)
cull_index = CullIndex(List=subtraction, Indices="-1", Wrap=True)
list_length = ListLength(List=cull_index)
in_num_legsteps_2 = RemoteReceiver(in_num_legsteps)
repeat_data = RepeatData(Data="0", Length=expr("X-1", list_length))
merge_2 = Merge(Data1=flatten(repeat_data), Data2=in_num_legsteps_2)
subtraction_2 = Subtraction(A=cull_index, B=merge_2)
in_int_proportsleg = RemoteSender(subtraction_2)

# ----
create_stack = CreateStack(UIElements=[create_rhino_pick_button, create_rhino_pick_button_2], Horizontal=True)
entwine_2 = Entwine(Branch00=create_text_box_3, Branch01=create_label_2, Branch02=create_stack, FlattenInputs=True)  # -> flatten(Result)
create_stack_2 = CreateStack(UIElements=[create_button_2, create_button], Horizontal=True)
adjust_element_positioning = AdjustElementPositioning(ElementsToAdjust=create_toggle_2, AbsolutePositioning=False, HorizontalAlignment=1, VerticalAlignment=2)
adjust_element_positioning_2 = AdjustElementPositioning(ElementsToAdjust=create_stack, Margin="0,0,0,0", AbsolutePositioning=False, HorizontalAlignment=1, VerticalAlignment=2)
adjust_element_positioning_3 = AdjustElementPositioning(ElementsToAdjust=create_stack_2, Margin="0,0,0,0", AbsolutePositioning=False, HorizontalAlignment=1, VerticalAlignment=0)
adjust_element_positioning_4 = AdjustElementPositioning(ElementsToAdjust=create_toggle, AbsolutePositioning=False, HorizontalAlignment=1, VerticalAlignment=2)

# ---- group: CUT
data_15 = Data()
data_16 = Data()

# ---- group: INPUT
# Get Mesh Res
value_listener = ValueListener(Elements=create_text_box_3, SomeProperty=True)  # -> Values, Indices
number = Number(value_listener.Values)
in_num_res = RemoteSender(number)

# ----
value_listener_2 = ValueListener(Elements=create_rhino_pick_button, SomeProperty=True)  # -> Values, Indices
value_listener_3 = ValueListener(Elements=create_rhino_pick_button_2, SomeProperty=True)  # -> Values, Indices
value_listener_4 = ValueListener(Elements=create_text_box_2, SomeProperty=True)  # -> Values, Indices
value_listener_5 = ValueListener(Elements=create_pulldown_menu, SomeProperty=True)  # -> Values, Indices
value_listener_6 = ValueListener(Elements=create_text_box_4, SomeProperty=True)  # -> Values, Indices

# ---- group: INPUT
# Define TimeSteps
value_listener_7 = ValueListener(Elements=create_pulldown_menu_3, SomeProperty=True)  # -> Values, Indices
panel_17 = Panel("""60
12
6
4
2
1""")
mindex = MemberIndex(Set=concatenate, Member=value_listener_7.Values)  # -> Index, Count
item = ListItem(List=panel_17, Index=mindex.Index, Wrap=True)
in_num_timestep = RemoteSender(item)

# Define Analysis Period
# 0.C
value_listener_8 = ValueListener(Elements=create_pulldown_menu_2, SomeProperty=True)  # -> Values, Indices
panel_18 = Panel("""Annual analysis
Winter Week
Spring Week
Summer Week
Autumn  Week""")
ui_day = RemoteSender(value_listener_8.Indices)
in_num_analysisperiod = RemoteSender(value_listener_8.Indices)
list_item_4 = ListItem(List=panel_18, Index=value_listener_8.Indices, Wrap=True)
ui_analisisperiod = RemoteSender(list_item_4)

# ----
value_listener_9 = ValueListener(Elements=create_text_box, SomeProperty=True)  # -> Values, Indices
value_listener_10 = ValueListener(Elements=create_toggle, SomeProperty=True)  # -> Values, Indices
value_listener_11 = ValueListener(Elements=create_toggle_2, SomeProperty=True)  # -> Values, Indices
value_listener_12 = ValueListener(Elements=create_button, SomeProperty=True)  # -> Values, Indices
value_listener_13 = ValueListener(Elements=create_button_2, SomeProperty=True)  # -> Values, Indices
ui_locationid = RemoteSender(value_listener_5.Indices)

# ---- group: INPUT
# 0.B
ui_locationid_2 = RemoteReceiver(ui_locationid)
boolean_toggle_3 = BooleanToggle(True)
# EPW File URL: https://climate.onebuilding.org/WMO_Region_6_Europe/NLD_Netherlands/ZH_Zuid-Holland/NLD_ZH_Rotterdam.The.Hague.AP.063440_TMYx.2007-2021.zip
file_path_2 = FilePath("H:\Tools & Libraries\34 - Rhino\07_GH_SCRIPTS_KCAP_TOOLS\9000_ANALYSIS\9100_SUN\EPWs\")
directory_contents = DirectoryContents(FolderPath=file_path_2, Filter="*.epw", IncludeSubfolders=boolean_toggle_3)  # -> FilePaths, FileNames
list_length_2 = ListLength(List=directory_contents.FilePaths)
list_item_5 = ListItem(List=directory_contents.FilePaths, Index=ui_locationid_2, Wrap=False)
in_epw_path = RemoteSender(list_item_5)
smaller_than = SmallerThan(FirstNumber=ui_locationid_2, SecondNumber=list_length_2)  # -> SmallerThan, OrEqualTo
in_epw_bool = RemoteSender(smaller_than.SmallerThan)

# ----
directory_contents_2 = DirectoryContents(FolderPath=file_path, Filter="*.stat", IncludeSubfolders=boolean_toggle_3)  # -> FilePaths, FileNames

# ---- group: INPUT
in_epw_bool_2 = RemoteReceiver(in_epw_bool)
epw_data = Panel("https://climate.onebuilding.org/WMO_Region_6_Europe/NLD_Netherlands/index.html")
launch_url = LaunchURL(Launch=invert(in_epw_bool_2), URL=epw_data)

# ----
list_item_6 = ListItem(List=directory_contents_2.FilePaths, Index=ui_locationid_2, Wrap=False)
in_stat_path = RemoteSender(list_item_6)
in_stat_path_2 = RemoteReceiver(in_stat_path)
ui_analysis_title = RemoteSender(value_listener_4.Values)
in_epw_web = RemoteSender(value_listener_6.Values)

# ---- group: DATA
# Import Location from EPW File
in_epw_path_2 = RemoteReceiver(in_epw_path)
in_epw_web_2 = RemoteReceiver(in_epw_web)
in_epw_bool_3 = RemoteReceiver(in_epw_bool)
downloadepw = LBDownloadWeather(weather_URL=in_epw_web_2)  # -> epw_file, stat_file, ddy_file; plug-in component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
filter = StreamFilter(Gate=in_epw_bool_3, Stream0=downloadepw.epw_file, Stream1=in_epw_path_2)
importloc = LBImportLocation(epw_file=filter)  # -> location; plug-in component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

# ----
filter_2 = StreamFilter(Gate=in_epw_bool_3, Stream0=downloadepw.stat_file, Stream1=in_stat_path_2)
# Extract the main weeks of the year
importstat = LBImportSTAT(stat_file=filter_2)  # -> location, ashrae_zone, koppen_zone, clear_dir_norm_rad, clear_diff_horiz_rad, ann_heat_dday_996, ann_heat_dday_990, ann_cool_dday_004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; plug-in component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

# ---- group: DATA
text_split_2 = TextSplit(Text=importstat.typical_weeks, Separators=" ")
list_item_7 = ListItem(List=text_split_2, Index=0, Wrap=True)
list_item_8 = ListItem(List=text_split_2, Index=Slider(2, range=0..10), Wrap=True)
text_split_3 = TextSplit(Text=list_item_8, Separators="/")
text_split_4 = TextSplit(Text=list_item_7, Separators="/")
list_item_9 = ListItem(List=text_split_3, Index=0, Wrap=True)  # -> Item, Item1
list_item_10 = ListItem(List=text_split_4, Index=0, Wrap=True)  # -> Item, Item1
in_num_timestep_2 = RemoteReceiver(in_num_timestep)
start_month = Data(list_item_10.Item)
start_day = Data(list_item_10.Item1)
end_month = Data(list_item_9.Item)
end_day = Data(list_item_9.Item1)
analysisperiod = LBAnalysisPeriod(
    start_month=simplify(start_month),
    start_day=simplify(start_day),
    start_hour=0,
    end_month=simplify(end_month),
    end_day=simplify(end_day),
    end_hour=Slider(23, range=0..100),
    timestep=in_num_timestep_2)  # -> period, hoys, dates; plug-in component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
txt_dates = RemoteSender(analysisperiod.dates)
num_hoys = RemoteSender(analysisperiod.hoys)
panel_19 = Panel(analysisperiod.dates)

# ----
num_hoys_2 = RemoteReceiver(num_hoys)

# ---- group: DATA
lb_data_location = RemoteSender(importloc)

# ----
lb_data_location_2 = RemoteReceiver(lb_data_location)
sunpath = LBSunPath(location=lb_data_location_2, hoys=num_hoys_2, scale=1)  # -> report, vectors, altitudes, azimuths, hoys, sun_pts, analemma, daily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; plug-in component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

# ---- group: GEO
project = Project(Geometry=sunpath.vectors, Plane=PlaneXY(0, 0, 0))  # -> Geometry, Transform
angle = Angle(VectorA=project.Geometry, VectorB=sunpath.vectors)  # -> Angle, Reflex
º_error_3 = RemoteReceiver(º_error_2)
deg = Degrees(Radians=angle.Angle)
larger = LargerThan(FirstNumber=deg, SecondNumber=º_error_3)  # -> LargerThan, OrEqualTo
cull = CullPattern(List=sunpath.vectors, CullPattern=larger.OrEqualTo)
stack = StackTrees(Data0=flatten(cull), Data1=cull, Reduce=True)

# ---- group: DATA
cull_2 = CullPattern(List=sunpath.hoys, CullPattern=larger.OrEqualTo)
sort = SortList(Keys=flatten(cull_2))  # -> Keys, ValuesA
stack_2 = StackTrees(Data0=flatten(sort.Keys), Data1=cull_2, Reduce=True)

# ----
hoy = Data(stack_2)

# ---- group: LOGIC
in_num_analysisperiod_2 = RemoteReceiver(in_num_analysisperiod)
tstat = TreeStatistics(Tree=hoy)  # -> Paths, Length, Count
item_2 = ListItem(List=tstat.Paths, Index=in_num_analysisperiod_2, Wrap=True)
branch = TreeBranch(Tree=hoy, Path=item_2, MaintainPaths=True)

# ---- group: DATA
datetime = LBHOYToDateTime(hoy=sunpath.hoys)  # -> month, day, hour, minute, date; plug-in component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
cull_3 = CullPattern(List=datetime.hour, CullPattern=larger.OrEqualTo)
cull_4 = CullPattern(List=datetime.minute, CullPattern=larger.OrEqualTo)
time_2 = ConstructTime(Hour=cull_3, Minute=cull_4, Second=0)
split = TextSplit(Text=time_2, Separators=":")
cull_i = CullIndex(List=split, Indices="-1", Wrap=True)
join = TextJoin(Text=cull_i, Join=":")

stack_3 = StackTrees(Data0=flatten(datetime.month), Data1=datetime.month, Reduce=True)
stack_4 = StackTrees(Data0=flatten(datetime.day), Data1=datetime.day, Reduce=True)
month = Data(stack_3)
day = Data(stack_4)

datetime_2 = LBHOYToDateTime(hoy=branch)  # -> month, day, hour, minute, date; plug-in component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

number_slider_3 = Slider(1, range=0..1)
analysisperiod_2 = LBAnalysisPeriod(
    start_month=simplify(start_month),
    start_day=simplify(start_day),
    start_hour=number_slider_3,
    end_month=simplify(end_month),
    end_day=simplify(end_day),
    end_hour=number_slider_3,
    timestep=number_slider_3)  # -> period, hoys, dates; plug-in component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
stack_5 = StackTrees(Data0=flatten(analysisperiod_2.hoys), Data1=analysisperiod_2.hoys, Reduce=True)
lng = ListLength(List=stack_5)

# ---- group: LOGIC
in_num_analysisperiod_3 = RemoteReceiver(in_num_analysisperiod)
tstat_2 = TreeStatistics(Tree=month)  # -> Paths, Length, Count
item_3 = ListItem(List=tstat_2.Paths, Index=in_num_analysisperiod_3, Wrap=True)
branch_2 = TreeBranch(Tree=month, Path=item_3, MaintainPaths=True)

in_num_analysisperiod_4 = RemoteReceiver(in_num_analysisperiod)
tstat_3 = TreeStatistics(Tree=day)  # -> Paths, Length, Count
item_4 = ListItem(List=tstat_3.Paths, Index=in_num_analysisperiod_4, Wrap=True)
branch_3 = TreeBranch(Tree=day, Path=item_4, MaintainPaths=True)

# ---- group: DATA
shift = ShiftPaths(Data=simplify(join), Offset=-1)
tsort = SortText(Keys=flatten(join), Values=flatten(join), Culture=127)  # -> Keys, Values
tsort_2 = SortText(Keys=shift, Values=shift, Culture=127)  # -> Keys, Values
cset = CreateSet(List=tsort.Keys)  # -> Set, Map
cset_2 = CreateSet(List=tsort_2.Keys)  # -> Set, Map
item_5 = ListItem(List=cset.Set, Index=0, Wrap=True)  # -> Item1, Item
item_6 = ListItem(List=cset_2.Set, Index=0, Wrap=True)  # -> Item1, Item
stack_6 = StackTrees(Data0=flatten(item_5.Item1), Data1=item_6.Item1, Reduce=True)
stack_7 = StackTrees(Data0=flatten(item_5.Item), Data1=item_6.Item, Reduce=True)
end_hours = Data(stack_6)
start_hours = Data(stack_7)

# ----
item_7 = ListItem(List=datetime_2.day, Index=0, Wrap=True)  # -> Item1, Item
item_8 = ListItem(List=datetime_2.month, Index=0, Wrap=True)  # -> Item1, Item
in_num__end_day = RemoteSender(item_7.Item1)
in_num__start_day = RemoteSender(item_7.Item)

# ---- group: LOGIC
in_num_analysisperiod_5 = RemoteReceiver(in_num_analysisperiod)
tstat_4 = TreeStatistics(Tree=lng)  # -> Paths, Length, Count
item_9 = ListItem(List=tstat_4.Paths, Index=in_num_analysisperiod_5, Wrap=True)
branch_4 = TreeBranch(Tree=lng, Path=item_9, MaintainPaths=True)

# ----
in_num__end_month = RemoteSender(item_8.Item1)
in_num__start_month = RemoteSender(item_8.Item)

# ---- group: INPUT
# 2.A
geo_analysis_what_is_gonna_get_coloured = Geometry(value_listener_2.Values)
lb_geo__geometry = RemoteSender(geo_analysis_what_is_gonna_get_coloured)

# 4.A
geo_context = Geometry(value_listener_3.Values)
lb_geo_rawcontext = RemoteSender(geo_context)

# ----
lb_geo_rawcontext_2 = RemoteReceiver(lb_geo_rawcontext)

# ---- group: GEO
# Clean and filter breps
sort_objects_by_type = SortObjectsByType(RhinoObjects=lb_geo_rawcontext_2)  # -> Points, Curves, Surfaces, Breps, Meshes, TextObjects, HatchObjects, LightObjects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
deconstruct_brep = DeconstructBrep(Brep=sort_objects_by_type.Breps)  # -> flatten(Faces), Edges, Vertices
mesh_brep = MeshBrep(
    Brep=deconstruct_brep.Faces,
    Settings={GridMaxCount=0, GridMinCount=16, JaggedSeams=False, MaxEdgeLength=0, MinEdgeLength=0.0001, MinTolerance=0, Refine=True, RefineAngle=0, RelativeTolerance=0.65, SimplePlanes=True, Tolerance=0})
mesh = Mesh(mesh_brep)
null_item = NullItem(Item=mesh)  # -> NullFlags, InvalidFlags, Description
cull_pattern = CullPattern(List=mesh, CullPattern=invert(null_item.NullFlags))
merge_3 = Merge(Data1=cull_pattern, Data2=sort_objects_by_type.Meshes)
mesh_join = MeshJoin(Meshes=merge_3)
rebuild_mesh = RebuildMesh(
    Mesh=mesh_join,
    RebuildNormals="1",
    CullUnused="1",
    UnifyNormals="1",
    FlipNormals=False,
    IdenticalCombine=False,
    WeldVertices=0)
in_geo__context = RemoteSender(rebuild_mesh)

# ---- group: LOGIC
in_num_analysisperiod_6 = RemoteReceiver(in_num_analysisperiod)
tstat_5 = TreeStatistics(Tree=start_hours)  # -> Paths, Length, Count
item_10 = ListItem(List=tstat_5.Paths, Index=in_num_analysisperiod_6, Wrap=True)
branch_5 = TreeBranch(Tree=start_hours, Path=item_10, MaintainPaths=True)

in_num_analysisperiod_7 = RemoteReceiver(in_num_analysisperiod)
tstat_6 = TreeStatistics(Tree=end_hours)  # -> Paths, Length, Count
item_11 = ListItem(List=tstat_6.Paths, Index=in_num_analysisperiod_7, Wrap=True)
branch_6 = TreeBranch(Tree=end_hours, Path=item_11, MaintainPaths=True)

# ----
geometry_layer = RemoteSender(value_listener_9.Values)
ui_preview = RemoteSender(value_listener_11.Values)

# ---- group: LOGIC
in_num_analysisperiod_8 = RemoteReceiver(in_num_analysisperiod)
tstat_7 = TreeStatistics(Tree=stack)  # -> Paths, Length, Count
item_12 = ListItem(List=tstat_7.Paths, Index=in_num_analysisperiod_8, Wrap=True)
branch_7 = TreeBranch(Tree=stack, Path=item_12, MaintainPaths=True)

# ----
ui_runanalysis = RemoteSender(value_listener_10.Values)
ui_bakelegend = RemoteSender(value_listener_13.Values)

# ---- group: INPUT
# 0. After making sure the geometry is structured on specific layers, set the name of the option you want to analyse.
# 
# 1. Refresh the geometry if any changes have been made in the rhino model.
# 
# 2. The mesh resolution will be the size of the analysis grid. Adjust it according to the scale of the project or certification requirements. Usual values between 0.5 and 2.
# 
# 3. Save the EPW for the project location on your computer and imputh the path to the file.
# 
# 4. DA stept will influence the appearance of the legend and the coloring of the mesh. Change only if necessary!
# 
# The DA treshold represent the percentage of time DA is calculated. 50 represent 50% or half of the daylight hours. It's the default value in most certification standards. Change only if required in the standard!
# 
# 5. Set the sDA treshold required by the standard or certification. Most of the time the value is 50% or 65%.
# 
# 
# 
# 
# 6. SAVE and then RUN the analysis
# 
# 
# 
# 7. Make sure you are in Layout View in Rhino before baking the Legend. Also, edit the legend parameters from below before baking!
# 
# 
# 8. Make sure you are in Model View (perspective, top etc) before baking the Mesh.
# 7
# Bake legend
ui_bakelegend_2 = RemoteReceiver(ui_bakelegend)
bake_legend = RemoteSender(ui_bakelegend_2)

# ---- group: DATA / METAHOPPER
ui_bakelegend_3 = RemoteReceiver(ui_bakelegend)
data_dam_2 = DataDam(BufferDelay=10000000, BufferMode=0)
get_objects_of_same_type = GetObjectsOfSameType(Objects=data_dam_2)
longest_list = LongestList(ListListA=get_objects_of_same_type, ListListB=ui_bakelegend_3, PaddingMode=2)  # -> ListListA, ListListB
set_object_value = SetObjectValue(ObjectToSet=longest_list.ListListA, ValueToSet=longest_list.ListListB)

# ----
ui_bakemesh = RemoteSender(value_listener_12.Values)
num_days = RemoteSender(branch_4)
in_num__end_hour = RemoteSender(branch_6)
num__start_hour = RemoteSender(branch_5)
in_num__start_hour = RemoteSender(branch_5)
num__end_hour = RemoteSender(branch_6)
vec_culled = RemoteSender(branch_7)

# ---- group: CUT
data_17 = Data()
data_18 = Data()

# ----
vec_culled_2 = RemoteReceiver(vec_culled)

# ---- group: DATA
in_num_sungroups_3 = RemoteReceiver(in_num_sungroups)
consecutive_domains = ConsecutiveDomains(Numbers=in_num_sungroups_3, Additive=Toggle(False))
deconstruct_domain = DeconstructDomain(Domain=consecutive_domains)  # -> Start, End
subtraction_3 = Subtraction(A=deconstruct_domain.End, B=Slider(0.01, range=0..0.01))
construct_domain = ConstructDomain(DomainStart=deconstruct_domain.Start, DomainEnd=subtraction_3)

# ----
in_num_timestep_3 = RemoteReceiver(in_num_timestep)
data_19 = Data(vec_culled_2)
list_length_3 = ListLength(List=data_19)
division = Division(A=list_length_3, B=in_num_timestep_3)

# ---- group: DATA
in_num__start_month_2 = RemoteReceiver(in_num__start_month)
in_num__end_month_2 = RemoteReceiver(in_num__end_month)
in_num__end_hour_2 = RemoteReceiver(in_num__end_hour)
in_num__start_day_2 = RemoteReceiver(in_num__start_day)
in_num__start_hour_2 = RemoteReceiver(in_num__start_hour)
in_num__end_day_2 = RemoteReceiver(in_num__end_day)
concat = Concatenate(
    FragmentD="To ",
    FragmentA=in_num__end_day_2,
    FragmentC=" /",
    FragmentB=in_num__end_month_2,
    FragmentE=" at ",
    FragmentF=in_num__end_hour_2)
concat_2 = Concatenate(
    FragmentD="From ",
    FragmentA=in_num__start_day_2,
    FragmentC=" /",
    FragmentB=in_num__start_month_2,
    FragmentE=" at ",
    FragmentF=in_num__start_hour_2)
concatenate_2 = Concatenate(Fragment_A=concat_2, Fragment_B=concat)
txt_timeperiod = RemoteSender(concatenate_2)

# ----
vec_culled_3 = RemoteReceiver(vec_culled)
ui_runanalysis_2 = RemoteReceiver(ui_runanalysis)
ui_preview_2 = RemoteReceiver(ui_preview)

# ---- group: DATA
# Screen Ratio / Bounds
panel_20 = Panel("1")
# 3. Legend display
get_viewport_boundary_dimensions = GetViewportBoundaryDimensions(Refresh=ui_preview_2, Origin=Point(0, 0, 0), Scale=panel_20, xDim=1887, yDim=948)
dimensions = Dimensions(Surface=get_viewport_boundary_dimensions)  # -> UDimension, VDimension
cond_screenratio = RemoteSender(get_viewport_boundary_dimensions)
cond_screenh = RemoteSender(dimensions.VDimension)

# ----
# Data Box Titles
panel_21 = Panel("Project")

txt_timeperiod_2 = RemoteReceiver(txt_timeperiod)
ui_analysis_title_2 = RemoteReceiver(ui_analysis_title)
geometry_layer_2 = RemoteReceiver(geometry_layer)
sty_americarg_2 = RemoteReceiver(sty_americarg)
sty_americabold_2 = RemoteReceiver(sty_americabold)
entwine_3 = Entwine(
    Branch00=sty_americarg_2,
    Branch01=sty_americabold_2,
    Branch02=sty_americarg_2,
    Branch03=sty_americarg_2,
    Branch04=sty_americarg_2,
    FlattenInputs=True)
Z = UnitZ(Factor=Slider(0.2, range=0..1))
txt_americarg_2 = RemoteReceiver(txt_americarg)
cond_txtheight_2 = RemoteReceiver(cond_txtheight)
cond_screenh_2 = RemoteReceiver(cond_screenh)
division_2 = Division(A=cond_screenh_2, B=cond_txtheight_2)
txt_americarg_3 = RemoteReceiver(txt_americarg)
bold = BooleanToggle(True)
bold_2 = BooleanToggle(False)
ui_preview_3 = RemoteReceiver(ui_preview)
cond_screenratio_2 = RemoteReceiver(cond_screenratio)

# ---- group: CUT
data_20 = Data()
data_21 = Data()

# ----
negative = Negative(Value="-1")
bake_legend_2 = RemoteReceiver(bake_legend)

# ---- group: INPUT
# Project
# Data
panel_22 = Panel("""Project
Location""")
txt_projectplaceholder_2 = RemoteReceiver(txt_projectplaceholder)

# ----
ui_projectinfolabel = RemoteSender(panel_22)

# ---- group: INPUT (continued)
create_text_box_5 = CreateTextBox(Label=ui_projectinfolabel, DefaultText=txt_projectplaceholder_2, UpdateButton=False, showLabel=True)

# ----
entwine_4 = Entwine(Branch00=create_text_box_5, Branch01=create_text_box, FlattenInputs=True)  # -> flatten(Result)

# ---- group: INPUT
# Get Project Info
value_listener_14 = ValueListener(Elements=create_text_box_5, SomeProperty=True)  # -> Values, Indices
txt_date_2 = RemoteReceiver(txt_date)
stack_8 = StackTrees(Data0=value_listener_14.Values, Data1=txt_date_2, Reduce=True)
rev = ReverseList(List=flatten(stack_8))
ui_projectinfo = RemoteSender(rev)

# ----
ui_projectinfo_2 = RemoteReceiver(ui_projectinfo)

# ---- group: VIZ
in_int_proportsleg_2 = RemoteReceiver(reverse(in_int_proportsleg))
# Fix the legend colors
colour_swatch = ColourSwatch(SwatchColor=RGB(255, 0, 0))
colour_swatch_2 = ColourSwatch(SwatchColor=RGB(255, 198, 0))
colour_swatch_3 = ColourSwatch(SwatchColor=RGB(127, 253, 0))
colour_swatch_4 = ColourSwatch(SwatchColor=RGB(71, 143, 0))
colour_swatch_5 = ColourSwatch(SwatchColor=RGB(0, 217, 195))
colour_swatch_6 = ColourSwatch(SwatchColor=RGB(0, 66, 199))
colour_swatch_7 = ColourSwatch(SwatchColor=RGB(230, 41, 230))
colour_swatch_8 = ColourSwatch(SwatchColor=RGB(138, 0, 138))
colour_swatch_9 = ColourSwatch(SwatchColor=RGB(79, 0, 79))
colour_swatch_10 = ColourSwatch(SwatchColor=RGB(0, 0, 0))

merge_4 = Merge(Data1=colour_swatch_7, Data2=colour_swatch_8)
merge_5 = Merge(Data1=colour_swatch, Data2=colour_swatch_2)
merge_6 = Merge(Data1=colour_swatch_3, Data2=colour_swatch_4)
merge_7 = Merge(Data1=colour_swatch_5, Data2=colour_swatch_6)
subtraction_4 = Subtraction(A=in_int_proportsleg_2, B=1)
cull_pattern_2 = CullPattern(List=in_int_proportsleg_2, CullPattern=subtraction_4)
entwine_5 = Entwine(Branch00=merge_5, Branch01=merge_6, Branch02=merge_7, Branch03=merge_4, FlattenInputs=True)  # -> simplify(Result)
range = Range(Domain=Domain(0, 1), Steps=expr("x-1", cull_pattern_2))  # -> simplify(Range)
interpolate_color = InterpolateColor(Colors=entwine_5, InterpolationParameters=range)
stack_trees = StackTrees(Data0=interpolate_color, Data1=colour_swatch_9, Data2=colour_swatch_10, Reduce=True)
shift_paths = ShiftPaths(Data=stack_trees, Offset=-1)

col_fixleg = RemoteSender(shift_paths)

# ---- group: ENGINE
# 2. Run engine simulaiton
col_fixleg_2 = RemoteReceiver(col_fixleg)
legendpar = LBLegendParameters(max=division, colors=reverse(col_fixleg_2))  # -> leg_par; plug-in component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
lb_geo__geometry_2 = RemoteReceiver(lb_geo__geometry)
in_geo__context_2 = RemoteReceiver(in_geo__context)
in_num_res_2 = RemoteReceiver(in_num_res)
geometry = Geometry(lb_geo__geometry_2)
geometry_2 = Geometry(in_geo__context_2)
panel_23 = Panel(in_num_res_2)
in_num_timestep_4 = RemoteReceiver(in_num_timestep)
directsunhours = LBDirectSunHours(
    vectors=flatten(vec_culled_3),
    timestep=in_num_timestep_4,
    geometry=flatten(geometry),
    context=flatten(geometry_2),
    grid_size=panel_23,
    offset_dist="0.1",
    legend_par=legendpar,
    run=ui_runanalysis_2)  # -> report, points, results, mesh, legend, title, int_mtx; plug-in component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
lb_out_mesh = RemoteSender(directsunhours.mesh)
lb_out_num = RemoteSender(directsunhours.results)

# ---- group: DATA
lb_out_num_2 = RemoteReceiver(lb_out_num)
num_days_2 = RemoteReceiver(num_days)
number_2 = Number(lb_out_num_2)
division_3 = Division(A=number_2, B=num_days_2)
round_to_decimal_place = RoundToDecimalPlace(NumberX=division_3, DecimalPlace=Slider(2, range=0..10), RoundType=0)  # -> Rounded, Difference

series = Series(Start=0, Step=1, Count=Slider(16, range=0..100))
consecutive_domains_2 = ConsecutiveDomains(Numbers=series, Additive=Toggle(False))
deconstruct_domain_2 = DeconstructDomain(Domain=consecutive_domains_2)  # -> Start, End
subtraction_5 = Subtraction(A=deconstruct_domain_2.End, B=Slider(0.01, range=0..0.01))
replace_items = ReplaceItems(List=subtraction_5, Item=Slider(30, range=0..100), Indices="14", Wrap=False)
construct_domain_2 = ConstructDomain(DomainStart=deconstruct_domain_2.Start, DomainEnd=replace_items)
includes = Includes(Value=round_to_decimal_place.Rounded, Domain=graft(construct_domain_2))  # -> Includes, Deviation
boolean = Boolean(invert(includes.Includes))

lb_out_mesh_2 = RemoteReceiver(lb_out_mesh)
col_fixleg_3 = RemoteReceiver(reverse(col_fixleg))
cull_faces = CullFaces(Mesh=lb_out_mesh_2, Pattern=boolean)
deconstruct_mesh = DeconstructMesh(Mesh=cull_faces)  # -> simplify(Vertices), simplify(Faces), Colours, Normals
colour = Colour(simplify(graft(col_fixleg_3)))
tstat_8 = TreeStatistics(Tree=deconstruct_mesh.Faces)  # -> Paths, Length, Count
larger_2 = LargerThan(FirstNumber=tstat_8.Length, SecondNumber=Slider(0, range=0..100))  # -> LargerThan, OrEqualTo
cull_5 = CullPattern(List=tstat_8.Paths, CullPattern=larger_2.LargerThan)
branch_8 = TreeBranch(Tree=deconstruct_mesh.Vertices, Path=cull_5, MaintainPaths=True)
branch_9 = TreeBranch(Tree=deconstruct_mesh.Faces, Path=cull_5, MaintainPaths=True)
branch_10 = TreeBranch(Tree=colour, Path=cull_5, MaintainPaths=True)
construct_mesh = ConstructMesh(Vertices=branch_8, Faces=branch_9, Colours=branch_10)

# ----
includes_2 = Includes(Value=round_to_decimal_place.Rounded, Domain=graft(construct_domain))  # -> Includes, Deviation
boolean_2 = Boolean(invert(includes_2.Includes))
move = Move(Geometry=construct_mesh, Motion=Z)  # -> Geometry, Transform

# ---- group: DATA
area = Area(Geometry=flatten(construct_mesh))  # -> Area, Centroid
replace_nulls = ReplaceNulls(Items=area.Area, Replacements="0")  # -> Items, Count
list_indices = ListIndices(List=replace_nulls.Items)
includes_3 = Includes(Value=list_indices, Domain=graft(construct_domain))  # -> Includes, Deviation
cull_pattern_3 = CullPattern(List=list_indices, CullPattern=includes_3.Includes)
list_item_11 = ListItem(List=replace_nulls.Items, Index=cull_pattern_3, Wrap=True)
list_item_12 = ListItem(List=col_fixleg_3, Index=cull_pattern_3, Wrap=True)
sort_list = SortList(Keys=list_item_11, ValuesValuesA=list_item_12)  # -> Keys, reverse(ValuesValuesA)
list_item_13 = ListItem(List=sort_list.ValuesValuesA, Index=0, Wrap=True)  # -> flatten(Item)

# ---- group: VIZ
mesh_2 = Mesh(move.Geometry)

# ----
out_mesh_bake = RemoteSender(construct_mesh)
nullrep = ReplaceNulls(Items=list_item_13, Replacements=ColourSwatch(SwatchColor=RGB(255, 255, 255)))  # -> Items, Count
col_thesixcol = RemoteSender(nullrep.Items)

# ---- group: MATH
in_num_critic_2 = RemoteReceiver(in_num_critic)
construct_domain_3 = ConstructDomain(DomainStart="0", DomainEnd=in_num_critic_2)
avrg_hrs_per_day = Number(round_to_decimal_place.Rounded)
includes_4 = Includes(Value=avrg_hrs_per_day, Domain=construct_domain_3)  # -> Includes, Deviation
lb_out_mesh_3 = RemoteReceiver(lb_out_mesh)
area_2 = Area(Geometry=lb_out_mesh_3)  # -> Area, Centroid
cull_faces_2 = CullFaces(Mesh=lb_out_mesh_3, Pattern=includes_4.Includes)
cull_faces_3 = CullFaces(Mesh=lb_out_mesh_3, Pattern=invert(includes_4.Includes))
area_3 = Area(Geometry=cull_faces_2)  # -> Area, Centroid
area_4 = Area(Geometry=cull_faces_3)  # -> Area, Centroid
integer = Integer(area_2.Area)
integer_2 = Integer(area_4.Area)
division_4 = Division(A=integer_2, B=integer)
integer_3 = Integer(area_3.Area)
multiplication = Multiplication(A=division_4, B=100)
integer_4 = Integer(multiplication)

# ----
# 3. Basic preview and results
lb_out_mesh_4 = RemoteReceiver(lb_out_mesh)

# ---- group: VIZ
cull_faces_4 = CullFaces(Mesh=lb_out_mesh_4, Pattern=boolean_2)

mesh_edges = MeshEdges(Mesh=cull_faces_4)  # -> NakedEdges, InteriorEdges, NonManifoldEdges
join_curves = JoinCurves(Curves=mesh_edges.NakedEdges, Preserve=False)
number_slider_4 = Slider(-0.2, range=-1..0)
in_num_offsetcolors = RemoteSender(number_slider_4)
col_thesixcol_2 = RemoteReceiver(col_thesixcol)
offset_curve = OffsetCurve(Curve=join_curves, Distance=number_slider_4, Corners=1)
shift_paths_2 = ShiftPaths(Data=offset_curve, Offset=-1)
create_material = CreateMaterial(Diffuse=col_thesixcol_2, Specular=RGB(255, 255, 255), Emission=RGB(0, 0, 0), Transparency=0, Shine=0)
custom_preview_lineweights = CustomPreviewLineweights(
    Geometry=simplify(shift_paths_2),
    Shader=simplify(graft(create_material)),
    Thickness=Slider(5, range=0..10),
    Absolute=False)

# ---- group: MATH
lb_out_mesh_5 = RemoteReceiver(lb_out_mesh)
mesh_3 = Mesh(cull_faces_4)
area_5 = Area(Geometry=cull_faces_4)  # -> Area, Centroid
area_6 = Area(Geometry=mesh_3)  # -> Area, Centroid
area_7 = Area(Geometry=lb_out_mesh_5)  # -> Area, Centroid
mass_addition = MassAddition(Input=flatten(area_6.Area))  # -> Result, PartialResults
division_5 = Division(A=area_5.Area, B=area_7.Area)
integer_5 = Integer(flatten(area_5.Area))
division_6 = Division(A=area_6.Area, B=mass_addition.Result)
multiplication_2 = Multiplication(A=division_5, B=100)
integer_6 = Integer(flatten(multiplication_2))

# ---- group: VIZ
dispatch = Dispatch(List=cull_faces_4, DispatchPattern=[True, False])  # -> ListA, ListB
mesh_edges_2 = MeshEdges(Mesh=dispatch.ListA)  # -> NakedEdges, InteriorEdges, NonManifoldEdges
custom_preview_lineweights_2 = CustomPreviewLineweights(
    Geometry=mesh_edges_2.NakedEdges,
    Shader=ColourSwatch(SwatchColor=RGB(0, 0, 0)),
    Thickness=Slider(1, range=0..10),
    Absolute=False)

# ----
multiplication_3 = Multiplication(A=division_6, B=100)
integer_7 = Integer(multiplication_3)

# ---- group: OUT
pg_num_percentagepertile = RemoteSender(integer_6)
pg_num_areapertile = RemoteSender(integer_5)
sun = RemoteSender(integer_7)

pg_data_criticalpoints = RemoteSender(integer_4)
pg_num_criticalsqm = RemoteSender(integer_2)
pg_num_oksqm = RemoteSender(integer_3)

# ---- group: VIZ
geometry_layer_3 = RemoteReceiver(geometry_layer)
concatenate_3 = Concatenate(FragmentA="Mesh_", FragmentB=geometry_layer_3)
concat_3 = Concatenate(FragmentA=geometry_layer_3, FragmentB="::", FragmentC=concatenate_3)
define_object_attributes = DefineObjectAttributes(Name=concatenate_3, Layer=concat_3)  # -> graft(Attributes)
out_mesh_bake_2 = RemoteReceiver(flatten(out_mesh_bake))
ui_bakemesh_2 = RemoteReceiver(ui_bakemesh)
bake_objects = BakeObjects(Geometry=out_mesh_bake_2, Attributes=define_object_attributes, BakeName="LegendTitles", Bake=ui_bakemesh_2)

# ----
col_fixleg_4 = RemoteReceiver(col_fixleg)

# ---- group: VIZ
panel_24 = Panel("Climate Setup")
create_expander = CreateExpander(UIElements=entwine_4, Header="Project Information", Open=True)
create_expander_2 = CreateExpander(UIElements=entwine_2, Header="Geometry Setup", Open=True)
adjust_element_positioning_5 = AdjustElementPositioning(ElementsToAdjust=create_image, AbsolutePositioning=False, HorizontalAlignment=1, VerticalAlignment=2)

# ----
create_expander_3 = CreateExpander(
    UIElements=[create_pulldown_menu, create_pulldown_menu_3, create_text_box_4, create_pulldown_menu_2],
    Header=panel_24,
    Open=True)

# ---- group: DATA
# Legend texts
# Critical border Formating
cond_boldheight_2 = RemoteReceiver(cond_boldheight)
pg_num_criticalsqm_2 = RemoteReceiver(pg_num_criticalsqm)
cond_txtheight_3 = RemoteReceiver(cond_txtheight)
pg_num_percentagepertile_2 = RemoteReceiver(pg_num_percentagepertile)
pg_num_oksqm_2 = RemoteReceiver(pg_num_oksqm)
in_num_critic_3 = RemoteReceiver(in_num_critic)
in_num_critic_4 = RemoteReceiver(in_num_critic)
pg_num_areapertile_2 = RemoteReceiver(pg_num_areapertile)
set_units = Panel("hrs")
mass_addition_2 = MassAddition(CriticalM2=flatten(pg_num_oksqm_2))  # -> Result, PartialResults
mass_addition_3 = MassAddition(CriticalM2=flatten(pg_num_criticalsqm_2))  # -> Result, PartialResults
ui_analisisperiod_2 = RemoteReceiver(ui_analisisperiod)
panel_25 = Panel(""">1 Hrs
1 to 2 Hrs
2 to 4 Hrs
4 to 6 Hrs
6 to 10 Hrs
>10 Hrs""")
evaluate = Evaluate(Expression="x & \"\" & y", x=mass_addition_3.Result, y="m2")
concatenate_4 = Concatenate(FragmentA="Surfaces bellow ", FragmentB=in_num_critic_4, FragmentC=set_units, FragmentD=":")
concatenate_5 = Concatenate(FragmentA="Surfaces over ", FragmentB=in_num_critic_3, FragmentC=set_units, FragmentD=":")
multiplication_4 = Multiplication(A=cond_boldheight_2, B=Slider(0.03, range=0..0.04))
multiplication_5 = Multiplication(A=cond_txtheight_3, B=Slider(0.017, range=0..0.04))
panel_26 = Panel("""Dark
Shadow
Semi-shadow
Semi-sunny
Sunny
Full sun""")
integer_8 = Integer(mass_addition_2.Result)
evaluate_2 = Evaluate(Expression="x & \"\" & y", x=integer_8, y="m2")
concatenate_6 = Concatenate(Fragment_A=ui_analisisperiod_2, Fragment_B=txt_timeperiod_2)
panel_27 = Panel(evaluate)
panel_28 = Panel(concatenate_4)
panel_29 = Panel(concatenate_5)
panel_30 = Panel(evaluate_2)
legend_title_2 = RemoteReceiver(legend_title)
percentage_data = Data(pg_num_percentagepertile_2)
data_22 = Data(pg_num_areapertile_2)
merge_8 = Merge(Data1=panel_28, Data2=panel_27, Data3=panel_29, Data4=panel_30, Data5=" ")  # -> reverse(flatten(Result))
concatenate_7 = Concatenate(
    FragmentJ=panel_26,
    FragmentA=panel_25,
    FragmentB=" (",
    FragmentC=percentage_data,
    FragmentD="%",
    FragmentG="-",
    FragmentH=data_22,
    FragmentI="m2",
    FragmentF=")")
txt_critalsurfaces = RemoteSender(merge_8)
ui_boldheight = RemoteSender(multiplication_4)
ui_txtheight = RemoteSender(multiplication_5)
txt_suntypesg = RemoteSender(concatenate_7)

# ---- group: INPUT
txt_critalsurfaces_2 = RemoteReceiver(reverse(txt_critalsurfaces))
text_join = TextJoin(Text=txt_critalsurfaces_2)
create_text_block = CreateTextBlock(Text=text_join, TextSize=Slider(14, range=0..100), Justification=1)

# ---- group: VIZ (continued)
adjust_element_positioning_6 = AdjustElementPositioning(
    ElementsToAdjust=create_text_block,
    Margin="0,20,0,0",
    AbsolutePositioning=False,
    HorizontalAlignment=1,
    VerticalAlignment=2)

# ----
entwine_6 = Entwine(
    Branch00=create_image,
    Branch01=create_text_box_2,
    Branch02=create_expander_3,
    Branch03=create_expander,
    Branch04=create_expander_2,
    Branch05=create_label,
    Branch07=create_toggle_2,
    Branch08=create_toggle,
    Branch09=create_text_block,
    Branch010=create_stack_2,
    FlattenInputs=True)  # -> flatten(Result)

# ---- group: VIZ
add_elements = AddElements(Window=launch_window, Elements=flatten(entwine_6), DoVLChecking=True)  # -> AddedElements, ElementNames

# ----
entwine_7 = Entwine(
    Branch00=geometry_layer_2,
    Branch01=ui_analysis_title_2,
    Branch02=ui_analisisperiod_2,
    Branch03=txt_timeperiod_2,
    Branch04=legend_title_2,
    FlattenInputs=True)

# ---- group: DATA (continued)
txt_titlesg = RemoteSender(entwine_7)

# ----
ui_txtheight_2 = RemoteReceiver(ui_txtheight)
ui_txtheight_3 = RemoteReceiver(ui_txtheight)
ui_txtheight_4 = RemoteReceiver(ui_txtheight)

# ---- group: WHITE BACKGROUND
# White Background
cond_whiteband_2 = RemoteReceiver(cond_whiteband)
cond_screenratio_3 = RemoteReceiver(cond_screenratio)
number_slider_5 = Slider(0, range=0..100)

# ---- group: DATA
# Legend proportions
box_pie_chart = Slider(0.58, range=0..1)
box_project_info = Slider(0.58, range=0..1)
box_title = Slider(0.7, range=0..1)
box_legend = Slider(3, range=0..10)
box_logo = Slider(0.4, range=0..1)
inner_radius = Slider(0.55, range=0..1)
outer_radius = Slider(0.8, range=0..1)
label_radius = Slider(0.95, range=0..2)
cond_padding = RemoteSender(Slider(0.01, range=0..0.01))

# ---- group: DATA / PIE DIVS
merge_9 = Merge(Data1=inner_radius, Data2=outer_radius, Data3=label_radius)

# ---- group: DATA / VERTICAL DIVS
merge_10 = Merge(Data1=box_title, Data2=box_legend, Data3=box_pie_chart, Data4=box_project_info, Data5=box_logo)  # -> reverse(Result)

# ---- group: DATA (continued)
cond_relrow = RemoteSender(merge_10)
cond_piedivs = RemoteSender(merge_9)

# ----
# Base Grid Layout
cond_screenratio_4 = RemoteReceiver(cond_screenratio)
cond_padding_2 = RemoteReceiver(cond_padding)
cond_relrow_2 = RemoteReceiver(cond_relrow)
number_slider_6 = Slider(0.2, range=0..1)
dimensions_2 = Dimensions(Surface=cond_screenratio_4)  # -> UDimension, VDimension
division_7 = Division(A=dimensions_2.UDimension, B=dimensions_2.VDimension)
aspect_ratio = Number(division_7)
subtraction_6 = Subtraction(A=aspect_ratio, B=number_slider_6)
stack_trees_2 = StackTrees(Data0=subtraction_6, Data1=number_slider_6, Reduce=True)  # -> flatten(Tree)
cond_screenratio_5 = RemoteReceiver(cond_screenratio)
irregular_grid_tiles = IrregularGridTiles(
    Boundary=cond_screenratio_5,
    RelativeColumnSizes=stack_trees_2,
    RelativeRowSizes=cond_relrow_2,
    InteriorPadding=cond_padding_2,
    ExteriorPadding=cond_padding_2,
    PaddingAxis=0)
area_8 = Area(Geometry=irregular_grid_tiles)  # -> Area, Centroid
sort_points = SortPoints(Points=area_8.Centroid)  # -> Points, Indices
list_item_14 = ListItem(List=irregular_grid_tiles, Index=sort_points.Indices, Wrap=True)
cond_maingrid = RemoteSender(list_item_14)

cond_relrow_3 = RemoteReceiver(cond_relrow)
cond_maingrid_2 = RemoteReceiver(cond_maingrid)
list_length_4 = ListLength(List=cond_relrow_3)
subtraction_7 = Subtraction(A=list_length_4, B=Slider(4, range=0..4))
negative_2 = Negative(Value=subtraction_7)
list_item_15 = ListItem(List=cond_maingrid_2, Index=negative_2, Wrap=True)

# ----
# Colour Tiles
in_num_legsteps_3 = RemoteReceiver(in_num_legsteps)
cond_maingrid_3 = RemoteReceiver(cond_maingrid)
cond_relrow_4 = RemoteReceiver(cond_relrow)
list_length_5 = ListLength(List=cond_relrow_4)
subtraction_8 = Subtraction(A=list_length_5, B=Slider(3, range=0..10))
negative_3 = Negative(Value=subtraction_8)
list_item_16 = ListItem(List=cond_maingrid_3, Index=negative_3, Wrap=True)
explode = Explode(Curve=list_item_16, Recursive=True)  # -> Segments, Vertices
list_item_17 = ListItem(List=explode.Segments, Index="-1", Wrap=True)
range_2 = Range(Domain=Domain(0, 1), Steps=expr("x+1", in_num_legsteps_3))
shatter = Shatter(Curve=reparameterize(list_item_17), Parameters=range_2)
cull_index_2 = CullIndex(List=shatter, Indices="0", Wrap=True)
explode_2 = Explode(Curve=cull_index_2, Recursive=True)  # -> simplify(Segments), Vertices
length = Length(Curve=explode_2.Segments)
unit_x = UnitX(Factor=length)
extrude = Extrude(Base=explode_2.Segments, Direction=unit_x)
deconstruct_brep_2 = DeconstructBrep(Brep=extrude)  # -> Faces, Edges, Vertices
join_curves_2 = JoinCurves(Curves=deconstruct_brep_2.Edges, Preserve=False)
mesh_4 = Mesh(join_curves_2)
deconstruct_mesh_2 = DeconstructMesh(Mesh=mesh_4)  # -> Vertices, Faces, Colours, Normals
col_fixleg_5 = RemoteReceiver(col_fixleg)
construct_mesh_2 = ConstructMesh(
    Vertices=simplify(deconstruct_mesh_2.Vertices),
    Faces=simplify(deconstruct_mesh_2.Faces),
    Colours=simplify(graft(col_fixleg_5)))
draw_a_mesh = DrawAMesh(Mesh=construct_mesh_2, PixelDepth=Slider(1, range=0..1))

# ----
# Grouping Tiles
in_int_proportsleg_3 = RemoteReceiver(in_int_proportsleg)
in_num_offsetcolors_2 = RemoteReceiver(in_num_offsetcolors)
in_num_legsteps_4 = RemoteReceiver(in_num_legsteps)
number_slider_7 = Slider(1, range=0..1)
repeat_data_2 = RepeatData(Data=number_slider_7, Length=expr("x+1", in_num_legsteps_4))
irregular_grid_tiles_2 = IrregularGridTiles(
    Boundary=list_item_16,
    RelativeColumnSizes=number_slider_7,
    RelativeRowSizes=repeat_data_2,
    InteriorPadding=0.02,
    ExteriorPadding="0",
    PaddingAxis=0)
cull_index_3 = CullIndex(List=irregular_grid_tiles_2, Indices="-1", Wrap=True)
bounding_box = BoundingBox(Content=cull_index_3, Plane=PlaneXY(0, 0, 0), UnionBox=True)  # -> Box, Box_2
irregular_grid_tiles_3 = IrregularGridTiles(
    Boundary=bounding_box.Box,
    RelativeColumnSizes=number_slider_7,
    RelativeRowSizes=in_int_proportsleg_3,
    InteriorPadding="0",
    ExteriorPadding="0",
    PaddingAxis=0)
offset_curve_2 = OffsetCurve(Curve=irregular_grid_tiles_3, Distance=expr("x*15", in_num_offsetcolors_2), Corners=1)
merge_11 = Merge(Data1=graft(irregular_grid_tiles_3), Data2=offset_curve_2)
boundary_surfaces = BoundarySurfaces(Edges=merge_11)
mesh_5 = Mesh(boundary_surfaces)
deconstruct_mesh_3 = DeconstructMesh(Mesh=mesh_5)  # -> Vertices, Faces, Colours, Normals
col_thesixcol_3 = RemoteReceiver(col_thesixcol)
construct_mesh_3 = ConstructMesh(
    Vertices=simplify(deconstruct_mesh_3.Vertices),
    Faces=simplify(deconstruct_mesh_3.Faces),
    Colours=simplify(graft(col_thesixcol_3)))
draw_a_mesh_2 = DrawAMesh(Mesh=construct_mesh_3, PixelDepth=1)

cond_maingrid_4 = RemoteReceiver(cond_maingrid)

# ----
# RESULTS DISPLAY
# Base Bounds
cond_maingrid_5 = RemoteReceiver(cond_maingrid)
cond_relrow_5 = RemoteReceiver(cond_relrow)
number_slider_8 = Slider(0.5, range=0..1)
list_length_6 = ListLength(List=cond_relrow_5)
x_minus_one = XMinusOne(NumberX=number_slider_8)
subtraction_9 = Subtraction(A=list_length_6, B=Slider(2, range=0..4))
absolute = Absolute(Value=x_minus_one)
negative_4 = Negative(Value=subtraction_9)
merge_12 = Merge(Data1=number_slider_8, Data2=absolute)
list_item_18 = ListItem(List=cond_maingrid_5, Index=negative_4, Wrap=True)
number_slider_9 = Slider(0.1, range=0..0.2)
horizontal_tiles = HorizontalTiles(
    Boundary=list_item_18,
    RelativeSizes=merge_12,
    Height=Slider(1, range=0..1),
    WidthPadding=number_slider_9,
    HeightPadding=number_slider_9)
list_item_19 = ListItem(List=horizontal_tiles, Index=0, Wrap=True)  # -> Item1, Item

# ----
# Pie Chart - Results
cond_pieheight_2 = RemoteReceiver(cond_pieheight)
cond_piedivs_2 = RemoteReceiver(cond_piedivs)
sty_americarg_3 = RemoteReceiver(sty_americarg)
col_thesixcol_4 = RemoteReceiver(flatten(col_thesixcol))
sun_2 = RemoteReceiver(sun)
list_item_20 = ListItem(List=cond_piedivs_2, Index=0, Wrap=True)  # -> Item, Item1, Item2
conduit_pie_style = ConduitPieStyle(
    InnerRadius=list_item_20.Item,
    OuterRadius=list_item_20.Item1,
    LabelRadius=list_item_20.Item2,
    LabelFontFace=sty_americarg_3,
    RelativeLabelHeight=cond_pieheight_2,
    LabelColor=ColourSwatch(SwatchColor=RGB(0, 0, 0)))
concatenate_8 = Concatenate(FragmentA=sun_2, FragmentB="%")
conduit_colorpalette = ConduitColorPalette(
    Seed=3,
    HueRange=Domain(-0.05, 0.05),
    SaturationRange=Domain(-0.15, 0.15),
    LuminanceRange=Domain(-0.1, 0.1),
    BaseColors=col_thesixcol_4)
draw_pie_chart = DrawPieChart(
    BoundaryRectangle=list_item_19.Item,
    Labels=flatten(concatenate_8),
    DataValues=flatten(sun_2),
    PieStyle=conduit_pie_style,
    ColorPalette=conduit_colorpalette)  # -> simplify(HUDPieChartObject)

# ----
# Critical Bounds
txt_critalsurfaces_3 = RemoteReceiver(txt_critalsurfaces)
sty_americarg_4 = RemoteReceiver(sty_americarg)
cond_screenh_3 = RemoteReceiver(cond_screenh)
cond_txtheight_4 = RemoteReceiver(cond_txtheight)
number_slider_10 = Slider(1, range=0..1)
merge_13 = Merge(
    Data1=Slider(3, range=0..10),
    Data2=number_slider_10,
    Data3=number_slider_10,
    Data4=number_slider_10,
    Data5=number_slider_10)
vertical_tiles = VerticalTiles(Boundary=list_item_19.Item1, RelativeSizes=merge_13, Width=Slider(1, range=0..1), WidthPadding=0.02, HeightPadding=0.02)
division_8 = Division(A=cond_screenh_3, B=cond_txtheight_4)
conduit_font = ConduitFont(
    Font=sty_americarg_4,
    TextHeight=division_8,
    AdaptiveHeight=True,
    TextSpacing=1.15,
    Alignment=0,
    Bold=Toggle(False),
    Italic=False,
    Color=RGB(0, 0, 0))
draw_text = DrawText(
    Boundary=graft(vertical_tiles),
    Text=graft(txt_critalsurfaces_3),
    TextOrdering=Slider(0, range=0..1),
    TextDistribution=Slider(1, range=0..1),
    OrientVertically=Toggle(True),
    CustomFont=conduit_font)

# ----
# Base Bounds
cond_relrow_6 = RemoteReceiver(cond_relrow)
# PROJECT INFORMATION
cond_maingrid_6 = RemoteReceiver(cond_maingrid)
list_length_7 = ListLength(List=cond_relrow_6)
subtraction_10 = Subtraction(A=list_length_7, B=Slider(1, range=0..1))
negative_5 = Negative(Value=subtraction_10)
list_item_21 = ListItem(List=cond_maingrid_6, Index=negative_5, Wrap=True)
number_slider_11 = Slider(1, range=0..1)
repeat_data_3 = RepeatData(Data=number_slider_11, Length=Slider(3, range=0..10))
merge_14 = Merge(Data1=number_slider_11, Data2=Slider(2, range=0..10))
irregular_grid_tiles_4 = IrregularGridTiles(
    Boundary=list_item_21,
    RelativeColumnSizes=merge_14,
    RelativeRowSizes=repeat_data_3,
    InteriorPadding=0.02,
    ExteriorPadding="0",
    PaddingAxis=0)
dispatch_2 = Dispatch(List=irregular_grid_tiles_4, DispatchPattern=[True, False])  # -> graft(ListA), graft(ListB)

cond_relrow_7 = RemoteReceiver(cond_relrow)

# ----
# KCAP's LOGO
mesh_6 = Mesh([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])
deconstruct_mesh_4 = DeconstructMesh(Mesh=mesh_6)  # -> Vertices, Faces, Colours, Normals
list_length_8 = ListLength(List=cond_relrow_7)
construct_mesh_4 = ConstructMesh(Vertices=deconstruct_mesh_4.Vertices, Faces=deconstruct_mesh_4.Faces, Colours=ColourSwatch(SwatchColor=RGB(0, 0, 0)))
negative_6 = Negative(Value=list_length_8)
list_item_22 = ListItem(List=cond_maingrid_4, Index=negative_6, Wrap=True)
mesh_join_2 = MeshJoin(Meshes=flatten(construct_mesh_4))
geometry_3 = Geometry(mesh_join_2)
bounding_rectangle = BoundingRectangle(Geometry=geometry_3, Plane=PlaneXY(0, 0, 0), Axis=0, Slide=0, Union=True)  # -> Bounding, DimensionX, DimensionY
area_9 = Area(Geometry=list_item_22)  # -> Area, Centroid
bounding_rectangle_2 = BoundingRectangle(Geometry=list_item_22, Plane=PlaneXY(0, 0, 0), Axis=0, Slide=0, Union=True)  # -> Bounding, DimensionX, DimensionY
area_10 = Area(Geometry=bounding_rectangle.Bounding)  # -> Area, Centroid
move_to_point = MoveToPoint(Geometry=geometry_3, PointA=area_10.Centroid, PointB=area_9.Centroid)  # -> Moved, Vector, Transform
division_9 = Division(A=bounding_rectangle_2.DimensionX, B=bounding_rectangle.DimensionX)
scale = Scale(Geometry=move_to_point.Moved, Center=area_9.Centroid, Factor=division_9)  # -> Geometry, Transform
draw_a_mesh_3 = DrawAMesh(Mesh=scale.Geometry, PixelDepth=Slider(0, range=0..10))

# ---- group: WHITE BACKGROUND (continued)
irregular_grid_tiles_5 = IrregularGridTiles(
    Boundary=cond_screenratio_3,
    RelativeColumnSizes=stack_trees_2,
    RelativeRowSizes=Slider(1, range=0..1),
    InteriorPadding=number_slider_5,
    ExteriorPadding=number_slider_5,
    PaddingAxis=0)
area_11 = Area(Geometry=irregular_grid_tiles_5)  # -> Area, Centroid
sort_points_2 = SortPoints(Points=area_11.Centroid)  # -> Points, Indices
list_item_23 = ListItem(List=irregular_grid_tiles_5, Index=sort_points_2.Indices, Wrap=True)
geometry_4 = Geometry(list_item_23)
list_item_24 = ListItem(List=geometry_4, Index="-1", Wrap=True)
offset_curve_3 = OffsetCurve(Curve=list_item_24, Distance=cond_whiteband_2, Plane=PlaneXY(0, 0, 0), Corners=1)  # -> flatten(Curve)
boundary_surfaces_2 = BoundarySurfaces(Edges=offset_curve_3)
mesh_7 = Mesh(boundary_surfaces_2)
deconstruct_mesh_5 = DeconstructMesh(Mesh=mesh_7)  # -> Vertices, Faces, Colours, Normals
construct_mesh_5 = ConstructMesh(
    Vertices=deconstruct_mesh_5.Vertices,
    Faces=deconstruct_mesh_5.Faces,
    Colours=ColourSwatch(SwatchColor=RGB(255, 255, 255)))
draw_a_mesh_4 = DrawAMesh(Mesh=flatten(construct_mesh_5), PixelDepth=1)

# ----
# Text boxes
graft_tree = GraftTree(Tree=irregular_grid_tiles_3, IncludeEmptyLists=True, IncludeNullItems=True)
explode_3 = Explode(Curve=graft_tree, Recursive=True)  # -> Segments, Vertices
list_item_25 = ListItem(List=explode_3.Segments, Index=Slider(1, range=0..1), Wrap=True)
curve_middle = CurveMiddle(Curve=list_item_25)
scale_nu = ScaleNU(Geometry=graft_tree, Plane=curve_middle, ScaleX=Slider(0.7, range=0..1), ScaleY=Slider(0.2, range=0..1), ScaleZ=1)  # -> Geometry, Transform
unit_y = UnitY(Factor=Slider(10, range=-1..20))
move_2 = Move(Geometry=simplify(scale_nu.Geometry), Motion=unit_y)  # -> Geometry, Transform

# ----
# Project Info Text to Screen
curve = Curve(simplify(dispatch_2.ListB))
conduit_font_2 = ConduitFont(
    Font=txt_americarg_2,
    TextHeight=division_2,
    AdaptiveHeight=True,
    TextSpacing=1.15,
    Alignment=0,
    Bold=bold_2,
    Italic=False,
    Color=RGB(0, 0, 0))
draw_text_2 = DrawText(
    Boundary=curve,
    Text=graft(ui_projectinfo_2),
    TextOrdering=1,
    TextDistribution=Slider(1, range=0..1),
    OrientVertically=Toggle(True),
    CustomFont=conduit_font_2)

# ----
# Categories Text to Screen
curve_2 = Curve(simplify(dispatch_2.ListA))
merge_15 = Merge(Data1=panel_21, Data2="Location", Data3="Date")  # -> reverse(Result)
concatenate_9 = Concatenate(FragmentA=graft(merge_15), FragmentB=":")
cond_boldheight_3 = RemoteReceiver(cond_boldheight)
cond_screenh_4 = RemoteReceiver(cond_screenh)
division_10 = Division(A=cond_screenh_4, B=cond_boldheight_3)
conduit_font_3 = ConduitFont(
    Font=txt_americarg_3,
    TextHeight=division_10,
    AdaptiveHeight=True,
    TextSpacing=1.15,
    Alignment=0,
    Bold=bold,
    Italic=False,
    Color=RGB(0, 0, 0))
draw_text_3 = DrawText(
    Boundary=curve_2,
    Text=concatenate_9,
    TextOrdering=1,
    TextDistribution=Slider(1, range=0..1),
    OrientVertically=Toggle(True),
    CustomFont=conduit_font_3)

# ----
# Categories Text to Screen
in_num_legsteps_5 = RemoteReceiver(in_num_legsteps)
cond_boldheight_4 = RemoteReceiver(cond_boldheight)
sty_americarg_5 = RemoteReceiver(sty_americarg)
cond_screenh_5 = RemoteReceiver(cond_screenh)
curve_3 = Curve(simplify(join_curves_2))
series_2 = Series(Start="0", Step=1, Count=in_num_legsteps_5)  # -> reverse(Series)
division_11 = Division(A=cond_screenh_5, B=cond_boldheight_4)
bold_3 = BooleanToggle(True)
conduit_font_4 = ConduitFont(
    Font=sty_americarg_5,
    TextHeight=division_11,
    AdaptiveHeight=True,
    TextSpacing=1.15,
    Alignment=Slider(0, range=0..2),
    Bold=bold_3,
    Italic=False,
    Color=RGB(0, 0, 0))
draw_text_4 = DrawText(
    Boundary=curve_3,
    Text=simplify(graft(series_2)),
    TextOrdering=1,
    TextDistribution=Slider(1, range=0..1),
    OrientVertically=Toggle(True),
    CustomFont=conduit_font_4)

# ----
# Text to screen
txt_suntypesg_2 = RemoteReceiver(txt_suntypesg)
cond_txtheight_5 = RemoteReceiver(cond_txtheight)
cond_screenh_6 = RemoteReceiver(cond_screenh)
sty_americarg_6 = RemoteReceiver(sty_americarg)
division_12 = Division(A=cond_screenh_6, B=cond_txtheight_5)
conduit_font_5 = ConduitFont(
    Font=sty_americarg_6,
    TextHeight=division_12,
    AdaptiveHeight=True,
    TextSpacing=1.15,
    Alignment=0,
    Bold=False,
    Italic=False,
    Color=RGB(0, 0, 0))
draw_text_5 = DrawText(
    Boundary=graft(move_2.Geometry),
    Text=graft(txt_suntypesg_2),
    TextOrdering=1,
    TextDistribution=Slider(1, range=0..1),
    OrientVertically=Toggle(True),
    CustomFont=conduit_font_5)

# ---- group: VIZ
# Base Grid Layout
horizontal_ratio_2 = RemoteReceiver(horizontal_ratio)
cond_padding_3 = RemoteReceiver(cond_padding)
layout_page_2 = RemoteReceiver(layout_page)
cond_relrow_8 = RemoteReceiver(cond_relrow)
dimensions_3 = Dimensions(Surface=layout_page_2)  # -> UDimension, VDimension
division_13 = Division(A=dimensions_3.UDimension, B=dimensions_3.VDimension)
subtraction_11 = Subtraction(A=division_13, B=horizontal_ratio_2)
stack_trees_3 = StackTrees(Data0=subtraction_11, Data1=horizontal_ratio_2, Reduce=True)  # -> flatten(Tree)
layout_page_3 = RemoteReceiver(layout_page)
irregular_grid_tiles_6 = IrregularGridTiles(
    Boundary=layout_page_3,
    RelativeColumnSizes=stack_trees_3,
    RelativeRowSizes=cond_relrow_8,
    InteriorPadding=cond_padding_3,
    ExteriorPadding=cond_padding_3,
    PaddingAxis=0)
area_12 = Area(Geometry=irregular_grid_tiles_6)  # -> Area, Centroid
sort_points_3 = SortPoints(Points=area_12.Centroid)  # -> Points, Indices
list_item_26 = ListItem(List=irregular_grid_tiles_6, Index=sort_points_3.Indices, Wrap=True)
layout_grid = RemoteSender(list_item_26)

# Base Bounds
cond_relrow_9 = RemoteReceiver(cond_relrow)
layout_grid_2 = RemoteReceiver(layout_grid)
bake_legend_3 = RemoteReceiver(bake_legend)
number_slider_12 = Slider(0.5, range=0..1)
x_minus_one_2 = XMinusOne(NumberX=number_slider_12)
list_length_9 = ListLength(List=cond_relrow_9)
absolute_2 = Absolute(Value=x_minus_one_2)
subtraction_12 = Subtraction(A=list_length_9, B=Slider(2, range=0..4))
merge_16 = Merge(Data1=number_slider_12, Data2=absolute_2)
negative_7 = Negative(Value=subtraction_12)
number_slider_13 = Slider(0.1, range=0..0.2)
list_item_27 = ListItem(List=layout_grid_2, Index=negative_7, Wrap=True)
horizontal_tiles_2 = HorizontalTiles(
    Boundary=list_item_27,
    RelativeSizes=merge_16,
    Height=Slider(1, range=0..1),
    WidthPadding=number_slider_13,
    HeightPadding=number_slider_13)
list_item_28 = ListItem(List=horizontal_tiles_2, Index=0, Wrap=True)  # -> Item1, Item

# ----
# TITLE
# Select Tile
# Inside Tiles
# Text to Screen
# Font Settings
txt_titlesg_2 = RemoteReceiver(txt_titlesg)
list_length_10 = ListLength(List=flatten(txt_titlesg_2))
cond_screenh_7 = RemoteReceiver(cond_screenh)
cond_txtheight_6 = RemoteReceiver(cond_txtheight)
division_14 = Division(A=cond_screenh_7, B=cond_txtheight_6)
conduit_font_6 = ConduitFont(
    Font=entwine_3,
    TextHeight=division_14,
    AdaptiveHeight=True,
    TextSpacing=1.15,
    Alignment=0,
    Bold=Toggle(True),
    Italic=False,
    Color=RGB(0, 0, 0))
txt_titlesg_3 = RemoteReceiver(txt_titlesg)

number_slider_14 = Slider(1, range=0..1)
repeat_data_4 = RepeatData(Data=number_slider_14, Length=list_length_10)
irregular_grid_tiles_7 = IrregularGridTiles(
    Boundary=list_item_15,
    RelativeColumnSizes=number_slider_14,
    RelativeRowSizes=repeat_data_4,
    InteriorPadding="0",
    ExteriorPadding="0",
    PaddingAxis=0)

draw_text_6 = DrawText(
    Boundary=reverse(simplify(graft(irregular_grid_tiles_7))),
    Text=simplify(graft(txt_titlesg_3)),
    TextOrdering=1,
    TextDistribution=Slider(1, range=0..1),
    OrientVertically=Toggle(True),
    CustomFont=simplify(conduit_font_6))

entwine_8 = Entwine(
    Branch00=draw_a_mesh_4,
    Branch01=draw_text_6,
    Branch02=draw_a_mesh,
    Branch03=draw_text_5,
    Branch04=draw_text_3,
    Branch05=draw_text,
    Branch06=draw_text_2,
    Branch07=draw_a_mesh_3,
    Branch08=draw_pie_chart,
    Branch09=draw_text_4,
    Branch010=draw_a_mesh_2,
    FlattenInputs=True)  # -> flatten(Result)
drawobjs = Data(entwine_8)
heads_up_display_hud = HeadsUpDisplayHUD(
    ShowHUD=ui_preview_3,
    DrawingObjects=drawobjs,
    DrawingBoundary=cond_screenratio_2,
    ConduitStyleSheet="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")

# ---- group: VIZ
# Pie Chart - Results
cond_piedivs_3 = RemoteReceiver(cond_piedivs)
col_thesixcol_5 = RemoteReceiver(flatten(col_thesixcol))
bake_legend_4 = RemoteReceiver(bake_legend)
sun_3 = RemoteReceiver(flatten(sun))
multiplication_6 = Multiplication(A=cond_piedivs_3, B=Slider(15.3, range=1..20))
list_item_29 = ListItem(List=multiplication_6, Index=0, Wrap=True)  # -> Item, Item1, Item2
division_15 = Division(A=sun_3, B="100")
area_13 = Area(Geometry=list_item_28.Item)  # -> Area, Centroid
circle = Circle(Plane=area_13.Centroid, Radius=list_item_29.Item)
txt_americarg_4 = RemoteReceiver(txt_americarg)
geometry_layer_4 = RemoteReceiver(geometry_layer)
geometry_layer_5 = RemoteReceiver(geometry_layer)
ui_txtheight_5 = RemoteReceiver(ui_txtheight)
concatenate_10 = Concatenate(FragmentA=graft("PieValue_"), FragmentB=geometry_layer_4)
concatenate_11 = Concatenate(FragmentA=graft("PieResults_"), FragmentB=geometry_layer_5)

# ----
cull_pattern_4 = CullPattern(List=sun_3, CullPattern=sun_3)
cull_index_4 = CullIndex(List=division_15, Indices="-1", Wrap=True)
mass_addition_4 = MassAddition(Input=cull_index_4)  # -> Result, PartialResults
subtraction_13 = Subtraction(A=negative, B=mass_addition_4.Result)
merge_17 = Merge(Data1=cull_index_4, Data2=subtraction_13)
mass_addition_5 = MassAddition(Input=merge_17)  # -> Result, PartialResults
concat_4 = Concatenate(FragmentA=geometry_layer_5, FragmentB="::", FragmentC=concatenate_11)

# ---- group: VIZ (continued)
concatenate_12 = Concatenate(FragmentA=cull_pattern_4, FragmentB="%")
shatter_2 = Shatter(Curve=reparameterize(circle), Parameters=mass_addition_5.PartialResults)
offset_curve_4 = OffsetCurve(Curve=shatter_2, Distance=expr("X/4", list_item_29.Item1), Corners=1)
offset_curve_5 = OffsetCurve(Curve=shatter_2, Distance=expr("X/2", list_item_29.Item2), Corners=1)
connect_curve_ends = ConnectCurveEnds(Curve1=shatter_2, Curve2=flatten(offset_curve_4), FlipEnds=False)
point_on_curve = PointOnCurve(offset_curve_5, parameter=0.5)
define_text_object_r6 = DefineTextObjectR6(
    Text=graft(concatenate_12),
    Plane=point_on_curve,
    DimensionStyle=txt_americarg_4,
    Justification=Slider(0, range=0..100),
    Size=ui_txtheight_5,
    OutputType="Text")
define_object_attributes_2 = DefineObjectAttributes(Name=concatenate_11, Layer=concat_4, Color=col_thesixcol_5)  # -> graft(Attributes)
define_hatch_r6 = DefineHatchR6(Curve=connect_curve_ends, Pattern="Solid", Rotation=0, Scale=1)
bake_objects_2 = BakeObjects(Geometry=define_hatch_r6, Attributes=define_object_attributes_2, BakeName=concatenate_11, Bake=bake_legend_4)
bake_objects_3 = BakeObjects(Geometry=define_text_object_r6, BakeName=concatenate_10, Bake=bake_legend_4)

# Grouping Tiles
in_num_offsetcolors_3 = RemoteReceiver(in_num_offsetcolors)
in_int_proportsleg_4 = RemoteReceiver(in_int_proportsleg)
in_num_legsteps_6 = RemoteReceiver(in_num_legsteps)
bake_legend_5 = RemoteReceiver(bake_legend)
number_slider_15 = Slider(1, range=0..1)
repeat_data_5 = RepeatData(Data=number_slider_15, Length=expr("x+1", in_num_legsteps_6))
geometry_layer_6 = RemoteReceiver(geometry_layer)
col_thesixcol_6 = RemoteReceiver(col_thesixcol)
concatenate_13 = Concatenate(FragmentA="LegendGroupsCol_", FragmentB=geometry_layer_6)

# ----
concat_5 = Concatenate(FragmentA=geometry_layer_6, FragmentB="::", FragmentC=concatenate_13)

# ---- group: VIZ
# Bake Titles
txt_americabold_2 = RemoteReceiver(txt_americabold)
ui_boldheight_2 = RemoteReceiver(ui_boldheight)
txt_americarg_5 = RemoteReceiver(txt_americarg)
ui_txtheight_6 = RemoteReceiver(ui_txtheight)
bake_legend_6 = RemoteReceiver(bake_legend)
txt_titlesg_4 = RemoteReceiver(txt_titlesg)
layout_grid_3 = RemoteReceiver(layout_grid)
list_length_11 = ListLength(List=merge_10)
subtraction_14 = Subtraction(A=list_length_11, B=Slider(4, range=0..4))
negative_8 = Negative(Value=subtraction_14)
list_item_30 = ListItem(List=layout_grid_3, Index=negative_8, Wrap=True)
number_slider_16 = Slider(1, range=0..1)
list_length_12 = ListLength(List=txt_titlesg_4)
repeat_data_6 = RepeatData(Data=number_slider_16, Length=list_length_12)  # -> flatten(Data)
irregular_grid_tiles_8 = IrregularGridTiles(
    Boundary=list_item_30,
    RelativeColumnSizes=number_slider_16,
    RelativeRowSizes=repeat_data_6,
    InteriorPadding=0.02,
    ExteriorPadding="0",
    PaddingAxis=0)  # -> reverse(simplify(Tiles))
deconstruct_brep_3 = DeconstructBrep(Brep=irregular_grid_tiles_8)  # -> Faces, Edges, simplify(Vertices)
list_item_31 = ListItem(List=deconstruct_brep_3.Vertices, Index=expr("0", 3), Wrap=True)
geometry_layer_7 = RemoteReceiver(geometry_layer)
concatenate_14 = Concatenate(FragmentA="LegendTitles_", FragmentB=geometry_layer_7)

# ----
merge_18 = Merge(Data1=txt_americabold_2, Data2=txt_americarg_5)  # -> graft(Result)
merge_19 = Merge(Data1=ui_boldheight_2, Data2=ui_txtheight_6)  # -> graft(Result)
concat_6 = Concatenate(FragmentA=geometry_layer_7, FragmentB="::", FragmentC=concatenate_14)

# ---- group: VIZ (continued)
define_object_attributes_3 = DefineObjectAttributes(Name=concatenate_14, Layer=concat_6)  # -> graft(Attributes)
define_text_object_r6_2 = DefineTextObjectR6(Text=txt_titlesg_4, Plane=list_item_31, DimensionStyle=merge_18, Size=merge_19, OutputType="Text")
bake_objects_4 = BakeObjects(Geometry=define_text_object_r6_2, Attributes=define_object_attributes_3, BakeName="LegendTitles", Bake=bake_legend_6)

# Bake Legend colors
cond_relrow_10 = RemoteReceiver(cond_relrow)
layout_grid_4 = RemoteReceiver(layout_grid)
bake_legend_7 = RemoteReceiver(bake_legend)
list_length_13 = ListLength(List=cond_relrow_10)
subtraction_15 = Subtraction(A=list_length_13, B=Slider(3, range=0..10))
negative_9 = Negative(Value=subtraction_15)
list_item_32 = ListItem(List=layout_grid_4, Index=negative_9, Wrap=True)
in_num_legsteps_7 = RemoteReceiver(in_num_legsteps)
explode_4 = Explode(Curve=list_item_32, Recursive=True)  # -> Segments, Vertices
list_item_33 = ListItem(List=explode_4.Segments, Index="-1", Wrap=True)
range_3 = Range(Domain=Domain(0, 1), Steps=in_num_legsteps_7)
shatter_3 = Shatter(Curve=reparameterize(list_item_33), Parameters=range_3)
cull_index_5 = CullIndex(List=shatter_3, Indices="0", Wrap=True)
explode_5 = Explode(Curve=shatter_3, Recursive=True)  # -> simplify(Segments), Vertices
length_2 = Length(Curve=explode_5.Segments)
unit_x_2 = UnitX(Factor=length_2)
extrude_2 = Extrude(Base=explode_5.Segments, Direction=unit_x_2)
deconstruct_brep_4 = DeconstructBrep(Brep=extrude_2)  # -> Faces, Edges, Vertices
join_curves_3 = JoinCurves(Curves=deconstruct_brep_4.Edges, Preserve=False)
geometry_layer_8 = RemoteReceiver(geometry_layer)
concatenate_15 = Concatenate(FragmentA="LegendColors_", FragmentB=geometry_layer_8)

irregular_grid_tiles_9 = IrregularGridTiles(
    Boundary=list_item_32,
    RelativeColumnSizes=number_slider_15,
    RelativeRowSizes=repeat_data_5,
    InteriorPadding="0",
    ExteriorPadding="0",
    PaddingAxis=0)
bounding_box_2 = BoundingBox(Content=irregular_grid_tiles_9, Plane=PlaneXY(0, 0, 0), UnionBox=True)  # -> Box, Box_2
irregular_grid_tiles_10 = IrregularGridTiles(
    Boundary=bounding_box_2.Box,
    RelativeColumnSizes=number_slider_15,
    RelativeRowSizes=in_int_proportsleg_4,
    InteriorPadding="0",
    ExteriorPadding="0",
    PaddingAxis=0)
offset_curve_6 = OffsetCurve(Curve=irregular_grid_tiles_10, Distance=expr("x*2", in_num_offsetcolors_3), Corners=1)
merge_20 = Merge(Data1=graft(irregular_grid_tiles_10), Data2=offset_curve_6)
define_hatch = DefineHatch(Curve=merge_20, Pattern="Solid", Rotation=0, Scale=1)
define_object_attributes_4 = DefineObjectAttributes(Name=concatenate_13, Layer=concat_5, Color=col_thesixcol_6)  # -> graft(Attributes)
move_3 = Move(Geometry=define_hatch, Motion="0,0,1")  # -> Geometry, Transform
bake_objects_5 = BakeObjects(Geometry=move_3.Geometry, Attributes=define_object_attributes_4, BakeName=concatenate_13, Bake=bake_legend_7)

# ----
concat_7 = Concatenate(FragmentA=geometry_layer_8, FragmentB="::", FragmentC=concatenate_15)

# ---- group: VIZ
# SunHoursTiles
in_num_legsteps_8 = RemoteReceiver(in_num_legsteps)
geometry_layer_9 = RemoteReceiver(geometry_layer)
txt_americarg_6 = RemoteReceiver(txt_americarg)
curve_4 = Curve(simplify(join_curves_3))
concatenate_16 = Concatenate(FragmentA="LegendHours_", FragmentB=geometry_layer_9)
series_3 = Series(Start="0", Step=1, Count=in_num_legsteps_8)  # -> reverse(Series)
define_object_attributes_5 = DefineObjectAttributes(Name=concatenate_15, Layer=concat_7)  # -> graft(Attributes)
define_text_object_r6_3 = DefineTextObjectR6(Text=graft(series_3), Plane=curve_4, DimensionStyle=txt_americarg_6, Size=ui_txtheight_4, OutputType="Text")
bake_objects_6 = BakeObjects(Geometry=define_text_object_r6_3, Attributes=define_object_attributes_5, BakeName=concatenate_16, Bake=bake_legend_5)

# ----
define_hatch_2 = DefineHatch(Curve=join_curves_3, Pattern="Solid", Rotation=0, Scale=1)

# ---- group: VIZ (continued)
define_object_attributes_6 = DefineObjectAttributes(Name=concatenate_15, Layer=concat_7, Color=col_fixleg_4)  # -> graft(Attributes)
bake_objects_7 = BakeObjects(Geometry=define_hatch_2, Attributes=define_object_attributes_6, BakeName=concatenate_15, Bake=bake_legend_7)

# Bake KCAP Logo
layout_grid_5 = RemoteReceiver(layout_grid)
bake_legend_8 = RemoteReceiver(bake_legend)
list_length_14 = ListLength(List=merge_10)
value_list = ValueList({"Solid", "Hatch1", "Hatch2", "Hatch3", "HatchDash", "Grid", "Grid60", "Plus", "Squares"}, selected="Solid")
logooutline = Curve(Tree({0;0}: [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], {0;1}: [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], {0;2}: [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], {0;3}: [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]))
negative_10 = Negative(Value=list_length_14)
define_hatch_3 = DefineHatch(Curve=logooutline, Pattern=value_list, Rotation=0, Scale=1)  # -> simplify(flatten(Hatch))
list_item_34 = ListItem(List=layout_grid_5, Index=negative_10, Wrap=True)
area_14 = Area(Geometry=list_item_34)  # -> Area, Centroid
bounding_rectangle_3 = BoundingRectangle(Geometry=list_item_34, Plane=PlaneXY(0, 0, 0), Axis=0, Slide=0, Union=True)  # -> Bounding, DimensionX, DimensionY
bounding_rectangle_4 = BoundingRectangle(Geometry=define_hatch_3, Plane=PlaneXY(0, 0, 0), Axis=0, Slide=0, Union=True)  # -> Bounding, DimensionX, DimensionY
area_15 = Area(Geometry=bounding_rectangle_4.Bounding)  # -> Area, Centroid
division_16 = Division(A=bounding_rectangle_3.DimensionX, B=bounding_rectangle_4.DimensionX)
move_to_point_2 = MoveToPoint(Geometry=define_hatch_3, PointA=area_15.Centroid, PointB=area_14.Centroid)  # -> Moved, Vector, Transform
scale_2 = Scale(Geometry=move_to_point_2.Moved, Center=area_14.Centroid, Factor=expr("X*.95", division_16))  # -> Geometry, Transform
geometry_layer_10 = RemoteReceiver(geometry_layer)
concatenate_17 = Concatenate(FragmentA="Logo_", FragmentB=geometry_layer_10)

# ----
concat_8 = Concatenate(FragmentA=geometry_layer_10, FragmentB="::", FragmentC=concatenate_17)

# ---- group: VIZ (continued)
define_object_attributes_7 = DefineObjectAttributes(Name=concatenate_17, Layer=concat_8, Color=ColourSwatch(SwatchColor=RGB(0, 0, 0)))  # -> graft(Attributes)
bake_objects_8 = BakeObjects(Geometry=scale_2.Geometry, Attributes=define_object_attributes_7, BakeName=concatenate_17, Bake=bake_legend_8)

# Bake Project information
layout_grid_6 = RemoteReceiver(layout_grid)
list_length_15 = ListLength(List=merge_10)
ui_projectinfo_3 = RemoteReceiver(flatten(ui_projectinfo))
subtraction_16 = Subtraction(A=list_length_15, B=Slider(1, range=0..1))
negative_11 = Negative(Value=subtraction_16)
list_item_35 = ListItem(List=layout_grid_6, Index=negative_11, Wrap=True)
number_slider_17 = Slider(1, range=0..1)
list_length_16 = ListLength(List=ui_projectinfo_3)
repeat_data_7 = RepeatData(Data=number_slider_17, Length=list_length_16)
merge_21 = Merge(Data1=number_slider_17, Data2=Slider(2, range=0..10))
irregular_grid_tiles_11 = IrregularGridTiles(
    Boundary=list_item_35,
    RelativeColumnSizes=merge_21,
    RelativeRowSizes=repeat_data_7,
    InteriorPadding=0.02,
    ExteriorPadding="0",
    PaddingAxis=0)
dispatch_3 = Dispatch(List=irregular_grid_tiles_11, DispatchPattern=[True, False])  # -> graft(ListA), graft(ListB)
curve_5 = Curve(simplify(dispatch_3.ListA))
curve_6 = Curve(simplify(dispatch_3.ListB))
explode_6 = Explode(Curve=curve_5, Recursive=True)  # -> Segments, Vertices
merge_22 = Merge(Data1="Project", Data2="Location", Data3="Date")  # -> reverse(Result)
list_item_36 = ListItem(List=explode_6.Vertices, Index=0, Wrap=True)
txt_americabold_3 = RemoteReceiver(txt_americabold)
geometry_layer_11 = RemoteReceiver(geometry_layer)
txt_americarg_7 = RemoteReceiver(txt_americarg)
ui_txtheight_7 = RemoteReceiver(ui_txtheight)
concatenate_18 = Concatenate(FragmentA=graft(merge_22), FragmentB=":")
geometry_layer_12 = RemoteReceiver(geometry_layer)
concatenate_19 = Concatenate(FragmentA=graft("ProjectInfo_"), FragmentB=geometry_layer_12)
concatenate_20 = Concatenate(FragmentA=graft("ProjectLabels_"), FragmentB=geometry_layer_11)
define_object_attributes_8 = DefineObjectAttributes(Name=concatenate_20, Layer=concatenate_20)  # -> graft(Attributes)
define_text_object_r6_4 = DefineTextObjectR6(Text=graft(ui_projectinfo_3), Plane=curve_6, DimensionStyle=txt_americarg_7, Size=ui_txtheight_7, OutputType="Text")
define_text_object_r6_5 = DefineTextObjectR6(Text=concatenate_18, Plane=list_item_36, DimensionStyle=txt_americabold_3, Size=ui_txtheight_7, OutputType="Text")
bake_objects_9 = BakeObjects(Geometry=define_text_object_r6_5, Attributes=define_object_attributes_8, BakeName=concatenate_20, Bake=bake_legend_2)

# ----
concat_9 = Concatenate(FragmentA=geometry_layer_12, FragmentB="::", FragmentC=concatenate_19)
concat_10 = Concatenate(FragmentA=geometry_layer_11, FragmentB="::", FragmentC=concatenate_20)

# ---- group: VIZ (continued)
define_object_attributes_9 = DefineObjectAttributes(Name=concatenate_19, Layer=concat_9)  # -> graft(Attributes)
bake_objects_10 = BakeObjects(Geometry=define_text_object_r6_4, Attributes=define_object_attributes_9, BakeName=concatenate_19, Bake=bake_legend_2)

number_slider_18 = Slider(1, range=0..1)
merge_23 = Merge(
    Data1=Slider(3, range=0..10),
    Data2=number_slider_18,
    Data3=number_slider_18,
    Data4=number_slider_18,
    Data5=number_slider_18)
vertical_tiles_2 = VerticalTiles(Boundary=list_item_28.Item1, RelativeSizes=merge_23, Width=Slider(1, range=0..1), WidthPadding=0.02, HeightPadding=0.02)
txt_critalsurfaces_4 = RemoteReceiver(txt_critalsurfaces)
txt_americarg_8 = RemoteReceiver(txt_americarg)
geometry_layer_13 = RemoteReceiver(geometry_layer)
curve_7 = Curve(simplify(vertical_tiles_2))
concatenate_21 = Concatenate(FragmentA=graft("CrittalLimitVal_"), FragmentB=geometry_layer_13)
define_text_object_r6_6 = DefineTextObjectR6(Text=txt_critalsurfaces_4, Plane=curve_7, DimensionStyle=txt_americarg_8, Size=ui_txtheight_2, OutputType="Text")

# ----
concat_11 = Concatenate(FragmentA=geometry_layer_13, FragmentB="::", FragmentC=concatenate_21)

# ---- group: VIZ (continued)
define_object_attributes_10 = DefineObjectAttributes(Name=concatenate_21, Layer=concat_11)  # -> graft(Attributes)
bake_objects_11 = BakeObjects(Geometry=define_text_object_r6_6, Attributes=define_object_attributes_10, BakeName=concatenate_21, Bake=bake_legend_3)

# Text boxes
graft_tree_2 = GraftTree(Tree=irregular_grid_tiles_10, IncludeEmptyLists=True, IncludeNullItems=True)
explode_7 = Explode(Curve=graft_tree_2, Recursive=True)  # -> Segments, Vertices
list_item_37 = ListItem(List=explode_7.Segments, Index=Slider(1, range=0..1), Wrap=True)
curve_middle_2 = CurveMiddle(Curve=list_item_37)
scale_nu_2 = ScaleNU(Geometry=graft_tree_2, Plane=curve_middle_2, ScaleX=Slider(0.7, range=0..1), ScaleY=Slider(0.2, range=0..1), ScaleZ=1)  # -> Geometry, Transform
unit_y_2 = UnitY(Factor=Slider(1, range=-20..20))
move_4 = Move(Geometry=scale_nu_2.Geometry, Motion=unit_y_2)  # -> Geometry, Transform
explode_8 = Explode(Curve=move_4.Geometry, Recursive=True)  # -> Segments, Vertices
geometry_layer_14 = RemoteReceiver(geometry_layer)
txt_suntypesg_3 = RemoteReceiver(txt_suntypesg)
txt_americarg_9 = RemoteReceiver(txt_americarg)
list_item_38 = ListItem(List=explode_8.Vertices, Index=-2, Wrap=True)
concatenate_22 = Concatenate(FragmentA="LegendValues_", FragmentB=geometry_layer_14)
define_text_object_r6_7 = DefineTextObjectR6(Text=graft(txt_suntypesg_3), Plane=list_item_38, DimensionStyle=txt_americarg_9, Size=ui_txtheight_3, OutputType="Text")

# ----
concat_12 = Concatenate(FragmentA=geometry_layer_14, FragmentB="::", FragmentC=concatenate_22)

# ---- group: VIZ (continued)
define_object_attributes_11 = DefineObjectAttributes(Name=concatenate_22, Layer=concat_12)  # -> graft(Attributes)
bake_objects_12 = BakeObjects(Geometry=define_text_object_r6_7, Attributes=define_object_attributes_11, BakeName=concatenate_22, Bake=bake_legend_5)
